# Grasshopper definition Adaptive comfort.gh (Grasshopper 1.0.8)
# Copyright: 2017
# plug-ins: Heteroptera, Pufferfish, MetaHopper, Wallacei

# ----
# EPW FILE
# General input
epw_file_path_barcelona = Panel("https://climate.onebuilding.org/WMO_Region_1_Africa/EGY_Egypt/QH_Al_Qahirah_Cairo/EGY_QH_Cairo.Intl.AP.623660_TMYx.zip")
epw_filepath = Data(epw_file_path_barcelona)

# ----
# Weather file
epw_filepath_2 = Data(epw_filepath)
downloadepw = LBDownloadWeather(weather_URL=epw_filepath_2)  # -> epw_file, stat_file, ddy_file; plug-in component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

pt = Point(Point(-2.722291582, 0.2658342869, 0))
northarrow = Ladybug_North(centerPt=pt, scale=Slider(0.1, range=0..0.1))  # -> northSign; plug-in component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

hb_building_programs = HBBuildingPrograms({"LargeOffice", "MediumOffice", "SmallOffice", "MidriseApartment", "HighriseApartment", "Retail", "StripMall", "PrimarySchool", "SecondarySchool", "SmallHotel", "LargeHotel", "Hospital", "Outpatient", "Laboratory", "Warehouse", "SuperMarket", "FullServiceRestaurant", "QuickServiceRestaurant", "Courthouse", "LargeDataCenterHighITE", "LargeDataCenterLowITE", "SmallDataCenterHighITE", "SmallDataCenterLowITE"}, selected="LargeOffice")

# ----
# Set Up ROOM or ZONE
number_slider = Slider(4.8, range=0..10)
domain_box = DomainBox(Base=PlaneXY(0, 0, 0), X=Slider(15, range=0..100), Y=Slider(6, range=0..10), Z=Slider(3, range=0..10))
volume = Volume(Geometry=domain_box)  # -> Volume, Centroid
panel = Panel(volume.Volume)
# Room Related
roomsolid = HBRoomFromSolid(geo=flatten(domain_box), program=hb_building_programs, conditioned=True)  # -> out, rooms; plug-in component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

importstat = LBImportSTAT(stat_file=downloadepw.stat_file)  # -> location, ashrae_zone, koppen_zone, clear_dir_norm_rad, clear_diff_horiz_rad, ann_heat_dday_996, ann_heat_dday_990, ann_cool_dday_004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; plug-in component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

importepw = LBImportEPW(epw_file=downloadepw.epw_file)  # -> location, dry_bulb_temperature, dew_point_temperature, relative_humidity, wind_speed, wind_direction, direct_normal_rad, diffuse_horizontal_rad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; disabled; plug-in component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
number_slider_2 = Slider(3, range=0..10)  # disabled
windprofile = LBWindProfile(met_wind_vel=importepw.wind_speed, met_wind_dir=importepw.wind_direction, profile_height=number_slider_2)  # -> out, wind_speeds, wind_vectors, anchor_pts, mesh_arrows, profile_curve, speed_axis, height_axis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; disabled; plug-in component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
windspeed = LBWindSpeed(met_wind_vel=importepw.wind_speed)  # -> out, air_speed; disabled; plug-in component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
xdata = LBDeconstructData(data=windspeed.air_speed)  # -> header, values; disabled; plug-in component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
data = Data()  # disabled
bounds = Bounds(Numbers=xdata.values)  # disabled
deconstruct_domain = DeconstructDomain(Domain=bounds)  # -> Start, End; disabled

# ----
# plane to analyze
deconstruct_brep = DeconstructBrep(Brep=domain_box)  # -> Faces, Edges, Vertices
center = Center(Geometry=deconstruct_brep.Faces)  # -> Center, Dimension
deconstruct = Deconstruct(Point=center.Center)  # -> XComponent, YComponent, ZComponent
smaller_than = SmallerThan(FirstNumber=deconstruct.ZComponent, SecondNumber=Slider(0.02, range=0..0.1))  # -> SmallerThan, OrEqualTo
cull_pattern = CullPattern(List=deconstruct_brep.Faces, CullPattern=smaller_than.SmallerThan)

number_slider_3 = Slider(0, range=0..5)
unit_z = UnitZ(Factor=Slider(1, range=0..1))
hb_construction_types = HBConstructionTypes({"SteelFramed", "WoodFramed", "Mass", "Metal Building"}, selected="SteelFramed")
addsubface = HBAddSubface()  # -> hb_obj; plug-in component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
move = Move(Geometry=cull_pattern, Motion=unit_z)  # -> Geometry, Transform

# ----
# Period
number_slider_4 = Slider(1, range=1..12)
number_slider_5 = Slider(1, range=1..31)
analysisperiod = LBAnalysisPeriod(
    start_month=number_slider_4,
    start_day=number_slider_5,
    start_hour=Slider(12, range=0..23),
    end_month=Slider(12, range=1..12),
    end_day=number_slider_5,
    end_hour=Slider(12, range=0..23))  # -> period, hoys, dates; plug-in component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

# ----
# Comfort param
lb_activities_met_list = LBActivitiesMetList({"Seated", "Standing", "supine"}, selected="Seated")
panel_2 = Panel("0.65")
adaptpar = LBAdaptiveComfortParameters(
    ashrae_or_en15251="False",
    neutral_offset=Slider(3, range=0..10),
    avgm_or_runmean="False",
    discr_or_cont_vel="False",
    cold_prevail_limit="15",
    conditioning="0")  # -> adapt_par; plug-in component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
solarbodypar = LBSolarBodyParameters(posture=lb_activities_met_list, sharp="45")  # -> sol_body_par; plug-in component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

set_group_properties = SetGroupProperties(Color=ColourSwatch(SwatchColor=RGB(216, 255, 184)))

# ---- group: ARE YOU SURE ?
toggle = BooleanToggle(True)

# ----
# Adpative thermal comfort
number_slider_6 = Slider(2, range=0..3)
legendpar = LBLegendParameters(min=Slider(26, range=0..100), max=Slider(33, range=0..100))  # -> leg_par; plug-in component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

# ----
# Floor plane set to 1 meter high
data_2 = Data(flatten(Tree({0;0;0}: [], {1;0}: ["C:\Users\Aly Mahmoud\simulation\unnamed\adaptive_comfort_map\initial_results/conditions"], {2;0}: ["C:\Users\Aly Mahmoud\simulation\unnamed\adaptive_comfort_map\results/temperature"], {3;0}: ["C:\Users\Aly Mahmoud\simulation\unnamed\adaptive_comfort_map\results/condition"], {4;0}: ["C:\Users\Aly Mahmoud\simulation\unnamed\adaptive_comfort_map\results/condition_intensity"], {5;0;0}: [79.01854714, 77.74343122, 77.2797527, 77.2797527, 77.04791345, 76.89335394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], {6;0;0}: [0, 0, 0, 0, 0, 0, 0, 0, 0, 0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], {7;0;0}: [20.98145286, 22.25656878, 22.7202473, 22.7202473, 22.95208655, 23.10664606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])))  # disabled
list_item = ListItem(List=data_2, Index=0, Wrap=True)  # -> Item, Item1, Item2, Item3, Item4, Item5, Item6, Item7; disabled
boolean_toggle = BooleanToggle(True)  # disabled
mesh = Mesh(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)  # disabled
thermalmtx = HBReadThermalMatrix(comf_result=list_item.Item2, load=boolean_toggle)  # -> comf_mtx; disabled; plug-in component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
face_normals = FaceNormals(Mesh=mesh)  # -> Centers, Normals; disabled
number_slider_7 = Slider(2, range=0..10)  # disabled
vizthermalmap = HBVisualizeThermalMap(comf_mtx=thermalmtx, mesh=flatten(mesh))  # -> out, mesh, legend, title, colors, values; disabled; plug-in component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
number_slider_8 = Slider(0.1, range=0..0.1)  # disabled
round_to_decimal_place = RoundToDecimalPlace(NumberX=vizthermalmap.values, DecimalPlace=number_slider_7, RoundType=0)  # -> Rounded, Difference; disabled
swatch = ColourSwatch(SwatchColor=RGB(0, 0, 0))  # disabled
tag = TextTag3D(Location=face_normals.Centers, Text=round_to_decimal_place.Rounded, Size=number_slider_8, Colour=swatch, Justification=7)  # disabled

boolean_toggle_2 = BooleanToggle(True)  # disabled

# ----
# Facade as a shader
number_slider_9 = Slider(0, range=0..5)
viznorm = HBVisualizeNormals(hb_objs=roomsolid.rooms)  # -> points, vectors; plug-in component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
list_item_2 = ListItem(List=deconstruct_brep.Faces, Index=number_slider_9, Wrap=True)
list_item_3 = ListItem(List=viznorm.vectors, Index=number_slider_9, Wrap=True)
amplitude = Amplitude(Vector=list_item_3, Amplitude=Slider(0.5, range=0..2))
move_2 = Move(Geometry=list_item_2, Motion=amplitude)  # -> Geometry, Transform

# ----
# Skin
number_slider_10 = Slider(6, range=2..22)
sframes = SurfaceFrames(Surface=move_2.Geometry, UCount=number_slider_10, VCount=number_slider_10)  # -> Frames, Parameters
panel_3 = Panel("""0
-1""")
division = Division(A=2.8, B=number_slider_10)
cull_i = CullIndex(List=sframes.Frames, Indices=panel_3, Wrap=True)
flip = FlipMatrix(Data=cull_i)
cull_i_2 = CullIndex(List=flip, Indices=panel_3, Wrap=True)  # -> flatten(List)
panel_4 = Panel("""0
1""")
cull = CullPattern(List=cull_i_2, CullPattern=panel_4)
cir = Circle(Plane=cull, Radius=division)
srfsplit = SurfaceSplit(Surface=move_2.Geometry, Curves=cir)
srf_sl = SrfSmallLarge(srf_list=srfsplit)  # -> smallest, largest
srf = Surface(srf_sl.smallest)

srf_2 = Surface(srf_sl.largest)

shade = HBShade(geo=srf_2)  # -> out, shades; plug-in component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

# ----
# Opening Parameters
ratio_to_the_elevation = Slider(0.55, range=0..1)
horizontal_spacing_between = Slider(2, range=0..10)
window_height = Slider(2, range=0..10)
sill_height = Slider(0.5, range=-0.5..2)
vertical_spacing_between = Slider(0, range=0..10)

# ----
# Windows
facparam = HBFacadeParameters(north=0, east=0, south=ratio_to_the_elevation, west=0)  # -> fac_par; plug-in component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
aperturesbyratio = HBAperturesByRatio(
    hb_objs=flatten(roomsolid.rooms),
    ratio=facparam,
    subdivide=Slider(3, range=0..10),
    win_height=window_height,
    sill_height=sill_height,
    horiz_separ=horizontal_spacing_between,
    vert_separ=vertical_spacing_between)  # -> out, hb_objs; plug-in component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

decnstrobj = HBDeconstructObject(hb_obj=aperturesbyratio.hb_objs)  # -> faces, apertures, doors, shades; plug-in component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
vizquick = HBVisualizeQuick(hb_objs=flatten(decnstrobj.apertures))  # -> geo; plug-in component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
aperture = HBAperture(geo=vizquick)  # -> out, apertures; plug-in component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

list_item_4 = ListItem(List=decnstrobj.faces, Index=number_slider_3, Wrap=True)
cull_index = CullIndex(List=decnstrobj.faces, Indices=number_slider_3, Wrap=True)
vizquick_2 = HBVisualizeQuick(hb_objs=flatten(list_item_4))  # -> geo; plug-in component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

vizquick_3 = HBVisualizeQuick(hb_objs=flatten(cull_index))  # -> geo; plug-in component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
face = HBFace(geo=vizquick_2)  # -> out, faces; plug-in component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

face_2 = HBFace(geo=vizquick_3, bc="adiabatic")  # -> out, faces; plug-in component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
roomsolid_2 = HBRoomFromSolid(geo=flatten(vizquick_3), conditioned=True)  # -> out, rooms; plug-in component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
vizquick_4 = HBVisualizeQuick(hb_objs=flatten(roomsolid_2.rooms))  # -> geo; plug-in component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

# ----
# Model
model = HBModel(rooms=flatten(aperturesbyratio.hb_objs), shades=flatten(shade.shades), apertures=flatten(aperture.apertures))  # -> out, model; plug-in component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
vizall = HBVisualizeAll(hb_objs=flatten(model.model))  # -> geo; plug-in component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
vizwiref = HBVisualizeWireframe(hb_objs=flatten(model.model))  # -> geo; plug-in component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

hb_face_attributes = HBFaceAttributes({"Display Name": "display_name", "Simulation Name (Identifier)": "identifier", "Boundary Condition": "boundary_condition", "Has Parent": "has_parent", "Parent": "parent", "Azimuth": "azimuth", "Altitude": "altitude", "Area": "area", "Perimeter": "perimeter", "Face Type": "type", "Aperture Is Operable": "is_operable", "Door Is Glass": "is_glass"}, selected="Boundary Condition")
# Faces labels
lablefaces = HBLabelFaces(hb_objs=flatten(model.model), attribute=hb_face_attributes)  # -> label_text, base_pts, labels, wire_frame; plug-in component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

# ----
# Visualize
vizbytype = HBVisualizeByType(hb_objs=model.model)  # -> walls, interior_walls, roofs, ceilings, exterior_floors, interior_floors, air_walls, apertures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; plug-in component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
data_3 = Data(vizbytype.outdoor_shades)
mesh_edges = MeshEdges(Mesh=data_3)  # -> NakedEdges, InteriorEdges, NonManifoldEdges
data_4 = Data(mesh_edges.NakedEdges)
mesh_2 = Mesh(data_3)

# ----
# Sensor Grid
number_slider_11 = Slider(0.5, range=0..10)
genpts = LBGeneratePointGrid(geometry=move.Geometry, grid_size=number_slider_11)  # -> points, vectors, face_areas, mesh; plug-in component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
points = Data(genpts.points)

rebuild_mesh = RebuildMesh(
    Mesh=genpts.mesh,
    RebuildNormals=False,
    CullUnused=False,
    UnifyNormals=False,
    FlipNormals=True,
    IdenticalCombine=False,
    WeldVertices=0)

sensorgrid = HBSensorGrid(positions=points, mesh=rebuild_mesh)  # -> grid; plug-in component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
assigngridsviews = HBAssignGridsAndViews(model=model.model, grids=flatten(sensorgrid))  # -> model; plug-in component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

# ----
# Analysis parameters:
# 
# HB room - Indoor analysis:
# Apreture testing location : South
# period: Annual
# Wind speed: 0.2
# human body parameters: Seated - facing side way to the window
adaptivemap = HBAdaptiveComfortMap(
    model=assigngridsviews,
    epw=downloadepw.epw_file,
    ddy=downloadepw.ddy_file,
    run_period=analysisperiod.period,
    air_speed=number_slider_6,
    comfort_par=adaptpar,
    solar_body_par=solarbodypar,
    run=toggle)  # -> out, env_conds, op_temp, condition, deg_neut, TCP, HSP, CSP; plug-in component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

# ----
# Cold sensation percentage
heatmap = LBSpatialHeatmap(values=adaptivemap.CSP, mesh=rebuild_mesh)  # -> mesh, legend, title, colors, legend_par, vis_set; plug-in component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
# HSP Heat sensation percentage %
heatmap_2 = LBSpatialHeatmap(values=adaptivemap.HSP, mesh=rebuild_mesh)  # -> mesh, legend, title, colors, legend_par, vis_set; plug-in component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
# Thermal comfort percentage
heatmap_3 = LBSpatialHeatmap(values=adaptivemap.TCP, mesh=rebuild_mesh)  # -> mesh, legend, title, colors, legend_par, vis_set; plug-in component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

envmtx = HBReadEnvironmentMatrix(env_conds=adaptivemap.env_conds, load=Toggle(True))  # -> comf_mtx; plug-in component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
thermalmtx_2 = HBReadThermalMatrix(comf_result=adaptivemap.condition, load=Toggle(True))  # -> comf_mtx; plug-in component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
vizthermalmap_2 = HBVisualizeThermalMap(comf_mtx=envmtx, mesh=flatten(rebuild_mesh), legend_par=legendpar)  # -> out, mesh, legend, title, colors, values; plug-in component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

round_to_decimal_place_2 = RoundToDecimalPlace(NumberX=vizthermalmap_2.values, DecimalPlace=Slider(1, range=0..10), RoundType=0)  # -> Rounded, Difference
tag_2 = TextTag3D(
    Location=points,
    Text=round_to_decimal_place_2.Rounded,
    Size=Slider(0.1, range=0..0.1),
    Colour=ColourSwatch(SwatchColor=RGB(0, 0, 0)),
    Justification=7)

# ----
# Wallacei
wallacei_x = WallaceiX(
    Genes=number_slider_10,
    Objectives=round_to_decimal_place_2.Rounded,
    Phenotype=vizwiref,
    allFitness="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",
    allFrontIdx="0|0;0|1;0|2;0|5;0|7;0|9",
    allGenomes="7_4_11_17_15_11_9_4_15_3",
    curFrontIdx="0|0;0|1;0|2;0|5;0|7;0|9",
    curFrontIdxSave="0|0;0|1;0|2;0|5;0|7;0|9",
    popGen="10,1",
    total="384953",
    wlcDone=True)  # -> WallaceiGenomes, FitnessValues, Data, Phenotypes
number_slider_12 = Slider(20, range=0..100)
distribute_to_grid = DistributeToGrid(
    FitnessValues=wallacei_x.FitnessValues,
    WallaceiPhenotypes=wallacei_x.Phenotypes,
    SizeOfTheGridInTheXDirection=number_slider_12,
    SizeOfTheGridInTheYDirection=number_slider_12,
    OutputOptions=0)  # -> DistributedFitnessValues, DistributedData, DistributedGeometries, DistributedMeshes, DistributedNumbers, GridLocations
tag_3 = TextTag3D(
    Text=distribute_to_grid.DistributedFitnessValues,
    Size=Slider(0.1, range=0..0.1),
    Colour=ColourSwatch(SwatchColor=RGB(0, 0, 0)),
    Justification=7)

# ----
# floor plane on the ground
data_5 = Data(flatten(Tree({0}: ["C:\Users\Aly Mahmoud\simulation\unnamed\adaptive_comfort_map\initial_results/conditions", "C:\Users\Aly Mahmoud\simulation\unnamed\adaptive_comfort_map\results/temperature", "C:\Users\Aly Mahmoud\simulation\unnamed\adaptive_comfort_map\results/condition", "C:\Users\Aly Mahmoud\simulation\unnamed\adaptive_comfort_map\results/condition_intensity"], {0;0}: [47.58208955, 47.88059701, 47.97014925, 47.91044776, 47.73134328, 47.82089552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])))  # disabled
list_item_5 = ListItem(List=data_5, Index=0, Wrap=True)  # -> Item, Item1, Item2, Item3, Item4, Item5, Item6, Item7; disabled
boolean_toggle_3 = BooleanToggle(True)  # disabled
mesh_3 = Mesh(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)  # disabled
thermalmtx_3 = HBReadThermalMatrix(comf_result=list_item_5.Item2, load=boolean_toggle_3)  # -> comf_mtx; disabled; plug-in component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
face_normals_2 = FaceNormals(Mesh=mesh_3)  # -> Centers, Normals; disabled
number_slider_13 = Slider(2, range=0..10)  # disabled
number_slider_14 = Slider(0.1, range=0..0.1)  # disabled
swatch_2 = ColourSwatch(SwatchColor=RGB(0, 0, 0))  # disabled

envmtx_2 = HBReadEnvironmentMatrix(env_conds=list_item_5.Item, load=boolean_toggle_2)  # -> comf_mtx; disabled; plug-in component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

vizthermalmap_3 = HBVisualizeThermalMap(comf_mtx=envmtx_2, mesh=flatten(mesh_3))  # -> out, mesh, legend, title, colors, values; disabled; plug-in component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
round_to_decimal_place_3 = RoundToDecimalPlace(NumberX=vizthermalmap_3.values, DecimalPlace=number_slider_13, RoundType=0)  # -> Rounded, Difference; disabled
tag_4 = TextTag3D(
    Location=face_normals_2.Centers,
    Text=round_to_decimal_place_3.Rounded,
    Size=number_slider_14,
    Colour=swatch_2,
    Justification=7)  # disabled

# ==== cluster SrfSmallLarge
srf_list = ClusterInput()
edges = BrepEdges(Brep=srf_list)  # -> Naked, Interior, NonManifold
len = Length(Curve=edges.Naked)
ma = MassAddition(Input=len)  # -> Result, PartialResults
pshift = ShiftPaths(Data=ma.Result, Offset=-1)
sort = SortList(Keys=pshift, ValuesA=srf_list)  # -> Keys, ValuesA
item = ListItem(List=reverse(sort.ValuesA), Index=0, Wrap=True)
cull_index = CullIndex(List=sort.ValuesA, Indices="-1", Wrap=True)
largest = ClusterOutput(item)
smallest = ClusterOutput(cull_index)
