# Grasshopper definition Encoding images Dataset perfo_skin.gh (Grasshopper 1.0.8)
# plug-ins: RhinoCodePluginGH, Heteroptera, Pufferfish, LunchBox, MetaHopper, Wallacei, Kangaroo2 Components

# ----
# List Generation
# Red Channel
# R channel Image
# Only R values
# Filter Points
# G channel Image
# Green Channel
# Only G values
# Blue Channel
# B channel Image
# Only B values
mersh_vectors = MershVectors()  # disabled
dist_facade_skin = DistFacadeSkin()  # disabled
max_heigth_room_z = MaxHeigthRoomZ()  # disabled
max_width_x = MaxWidthX()  # disabled
facade_window_srf = FacadeWindowSrf()  # disabled
r_color_domain = RColorDomain()  # disabled
skin_typology_srf = SkinTypologySrf()  # disabled
g_color_domain = GColorDomain()  # disabled
back_room_wall_srf = BackRoomWallSrf()  # disabled
b_color_domain = BColorDomain()  # disabled
deconstruct = Deconstruct(Point=mersh_vectors)  # -> XComponent, YComponent, ZComponent; disabled
panel = Panel("0")  # disabled
smaller_than = SmallerThan(FirstNumber=deconstruct.XComponent, SecondNumber=max_width_x)  # -> SmallerThan, OrEqualTo; disabled
larger_than = LargerThan(FirstNumber=deconstruct.ZComponent, SecondNumber=panel)  # -> LargerThan, OrEqualTo; disabled
smaller_than_2 = SmallerThan(FirstNumber=deconstruct.ZComponent, SecondNumber=max_heigth_room_z)  # -> SmallerThan, OrEqualTo; disabled
larger_than_2 = LargerThan(FirstNumber=deconstruct.XComponent, SecondNumber=panel)  # -> LargerThan, OrEqualTo; disabled
gate_and = GateAnd(A=larger_than.OrEqualTo, B=smaller_than_2.OrEqualTo, C=larger_than_2.OrEqualTo, D=smaller_than.OrEqualTo)  # disabled
cull_pattern = CullPattern(List=mersh_vectors, CullPattern=gate_and)  # disabled
deconstruct_2 = Deconstruct(Point=cull_pattern)  # -> XComponent, YComponent, ZComponent; disabled
deconstruct_3 = Deconstruct(Point=cull_pattern)  # -> XComponent, YComponent, ZComponent; disabled
panel_2 = Panel("0")  # disabled
panel_3 = Panel("0")  # disabled
equality = Equality(FirstNumber=deconstruct_2.ZComponent, SecondNumber=panel_2)  # -> Equality, Inequality; disabled
equality_2 = Equality(FirstNumber=deconstruct_3.XComponent, SecondNumber=panel_3)  # -> Equality, Inequality; disabled
cull_pattern_2 = CullPattern(List=cull_pattern, CullPattern=equality.Equality)  # disabled
cull_pattern_3 = CullPattern(List=cull_pattern, CullPattern=equality_2.Equality)  # disabled
list_length = ListLength(List=cull_pattern_2)  # disabled
list_length_2 = ListLength(List=cull_pattern_3)  # disabled
data = Data(dist_facade_skin)  # disabled
mesh_surface = MeshSurface(Surface=back_room_wall_srf, UCount=list_length, VCount=list_length_2, Overhang=True, Equalize=False)  # disabled
mesh_surface_2 = MeshSurface(Surface=skin_typology_srf, UCount=list_length, VCount=list_length_2, Overhang=True, Equalize=False)  # disabled
mesh_surface_3 = MeshSurface(Surface=facade_window_srf, UCount=list_length, VCount=list_length_2, Overhang=True, Equalize=False)  # disabled
list_length_3 = ListLength(List=mersh_vectors)  # disabled
mesh_join = MeshJoin(Meshes=mesh_surface_2)  # disabled
mesh_join_2 = MeshJoin(Meshes=mesh_surface)  # disabled
mesh_join_3 = MeshJoin(Meshes=mesh_surface_3)  # disabled
deconstruct_mesh = DeconstructMesh(Mesh=mesh_join)  # -> Vertices, Faces, Colours, Normals; disabled
deconstruct_mesh_2 = DeconstructMesh(Mesh=mesh_join_2)  # -> Vertices, Faces, Colours, Normals; disabled
deconstruct_mesh_3 = DeconstructMesh(Mesh=mesh_join_3)  # -> Vertices, Faces, Colours, Normals; disabled
panel_4 = Panel("0")  # disabled
panel_5 = Panel("0,0,0")  # disabled
deconstruct_4 = Deconstruct(Point=deconstruct_mesh.Vertices)  # -> XComponent, YComponent, ZComponent; disabled
deconstruct_5 = Deconstruct(Point=deconstruct_mesh_2.Vertices)  # -> XComponent, YComponent, ZComponent; disabled
deconstruct_6 = Deconstruct(Point=deconstruct_mesh_3.Vertices)  # -> XComponent, YComponent, ZComponent; disabled
duplicate_data = DuplicateData(Data=panel_5, Number=list_length_3, Order=True)  # disabled
duplicate_data_2 = DuplicateData(Data=panel_4, Number=list_length_3, Order=True)  # disabled
round = Round(Number=deconstruct_4.YComponent)  # -> Nearest, Floor, Ceiling; disabled
round_2 = Round(Number=deconstruct_5.YComponent)  # -> Nearest, Floor, Ceiling; disabled
round_3 = Round(Number=deconstruct_6.YComponent)  # -> Nearest, Floor, Ceiling; disabled
bounds = Bounds(Numbers=round.Nearest)  # disabled
construct_point = ConstructPoint(XCoordinate=deconstruct_4.XComponent, YCoordinate=data, ZCoordinate=deconstruct_4.ZComponent)  # disabled
construct_point_2 = ConstructPoint(XCoordinate=deconstruct_6.XComponent, YCoordinate=data, ZCoordinate=deconstruct_6.ZComponent)  # disabled
construct_point_3 = ConstructPoint(XCoordinate=deconstruct_5.XComponent, YCoordinate=data, ZCoordinate=deconstruct_5.ZComponent)  # disabled
bounds_2 = Bounds(Numbers=round_2.Nearest)  # disabled
panel_6 = Panel("1")  # disabled
bounds_3 = Bounds(Numbers=round_3.Nearest)  # disabled
control_wire_display = ControlWireDisplay(WireDisplay=panel_6)  # disabled
remap_numbers = RemapNumbers(Value=deconstruct_4.YComponent, Source=bounds, Target=g_color_domain)  # -> Mapped, Clipped; disabled
remap_numbers_2 = RemapNumbers(Value=deconstruct_5.YComponent, Source=bounds_2, Target=b_color_domain)  # -> Mapped, Clipped; disabled
remap_numbers_3 = RemapNumbers(Value=deconstruct_6.YComponent, Source=bounds_3, Target=r_color_domain)  # -> Mapped, Clipped; disabled
round_4 = Round(Number=remap_numbers.Mapped)  # -> Nearest, Floor, Ceiling; disabled
round_5 = Round(Number=remap_numbers_3.Mapped)  # -> Nearest, Floor, Ceiling; disabled
round_6 = Round(Number=remap_numbers_2.Mapped)  # -> Nearest, Floor, Ceiling; disabled
panel_7 = Panel("0")  # disabled
panel_8 = Panel("0")  # disabled
create_rtree = CreateRTree(InputGeometry=flatten(mersh_vectors))  # disabled
create_rtree_2 = CreateRTree(InputGeometry=flatten(mersh_vectors))  # disabled
panel_9 = Panel("0,0")  # disabled
concatenate = Concatenate(Fragment_B=panel_7, A=round_4.Nearest, B=panel_8, JoinSeparator=",")  # disabled
panel_10 = Panel("0,0")  # disabled
create_rtree_3 = CreateRTree(InputGeometry=flatten(mersh_vectors))  # disabled
concatenate_2 = Concatenate(FragmentB=round_5.Nearest, FragmentA=panel_9, JoinSeparator=",")  # disabled
concatenate_3 = Concatenate(FragmentB=panel_10, FragmentA=round_6.Nearest, JoinSeparator=",")  # disabled
rtree_closest_point = RTreeClosestPoint(SearchPoints=flatten(construct_point_2), RTree=create_rtree)  # -> ClosestPoint, ClosestIndex; disabled
rtree_closest_point_2 = RTreeClosestPoint(SearchPoints=flatten(construct_point), RTree=create_rtree_2)  # -> ClosestPoint, ClosestIndex; disabled
rtree_closest_point_3 = RTreeClosestPoint(SearchPoints=flatten(construct_point_3), RTree=create_rtree_3)  # -> ClosestPoint, ClosestIndex; disabled
replace_items = ReplaceItems(List=duplicate_data, Item=concatenate_2, Indices=rtree_closest_point.ClosestIndex, Wrap=False)  # disabled
replace_items_2 = ReplaceItems(List=duplicate_data_2, Item=round_5.Nearest, Indices=rtree_closest_point.ClosestIndex, Wrap=False)  # disabled
replace_items_3 = ReplaceItems(List=duplicate_data, Item=concatenate, Indices=rtree_closest_point_2.ClosestIndex, Wrap=False)  # disabled
replace_items_4 = ReplaceItems(List=duplicate_data_2, Item=round_4.Nearest, Indices=rtree_closest_point_2.ClosestIndex, Wrap=False)  # disabled
replace_items_5 = ReplaceItems(List=duplicate_data, Item=concatenate_3, Indices=rtree_closest_point_3.ClosestIndex, Wrap=False)  # disabled
replace_items_6 = ReplaceItems(List=duplicate_data_2, Item=remap_numbers_2.Mapped, Indices=rtree_closest_point_3.ClosestIndex, Wrap=False)  # disabled
g_channel_values = GChannelValues(replace_items_4)  # disabled
r_channel_values = RChannelValues(replace_items_2)  # disabled
g_channel_image = GChannelImage(replace_items_3)  # disabled
r_channel_image = RChannelImage(replace_items)  # disabled
b_channel_values = BChannelValues(replace_items_6)  # disabled
b_channel_image = BChannelImage(replace_items_5)  # disabled
concatenate_4 = Concatenate(R=replace_items_2, G=replace_items_4, B=replace_items_6, JoinSeparator=",")  # disabled
encoded_image = EncodedImage(concatenate_4)  # disabled

# ----
# Scale Images and Orient
xz_plane = XZPlane(Origin=Point(0, 0, 0))
dom = ConstructDomain(DomainStart="-4", DomainEnd="4")
number_slider = Slider(4, range=0..10)
rectangle = Rectangle(Plane=xz_plane, XSize=dom, YSize=dom, Radius=0)  # -> Rectangle, Length
surface = Surface(rectangle.Rectangle)
divide_surface = DivideSurface(Surface=surface, UCount=number_slider, VCount=number_slider)  # -> flatten(Points), Normals, Parameters

dim_x = Slider(15, range=3..15)

# ----
# General input
epw_file_path_barcelona = Panel("https://climate.onebuilding.org/WMO_Region_1_Africa/EGY_Egypt/QH_Al_Qahirah_Cairo/EGY_QH_Cairo.Intl.AP.623660_TMYx.zip")
epw_filepath = Data(epw_file_path_barcelona)

multiplication = Multiplication(A=dim_x, B=0.1)

list_item = ListItem(List=divide_surface.Points, Index=Slider(8, range=0..10), Wrap=True)

list_item_2 = ListItem(List=divide_surface.Points, Index=Slider(16, range=0..100), Wrap=True)

list_item_3 = ListItem(List=divide_surface.Points, Index=Slider(6, range=0..10), Wrap=True)

list_item_4 = ListItem(List=divide_surface.Points, Index=Slider(18, range=0..100), Wrap=True)

# ----
# Weather file
epw_filepath_2 = Data(epw_filepath)
# Room Related
downloadepw = LBDownloadWeather(weather_URL=epw_filepath_2)  # -> epw_file, stat_file, ddy_file; plug-in component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

pt = Point(Point(-2.722291582, 0.2658342869, 0))
northarrow = Ladybug_North(centerPt=pt, scale=Slider(0.1, range=0..0.1))  # -> northSign; plug-in component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

hb_building_programs = HBBuildingPrograms({"LargeOffice", "MediumOffice", "SmallOffice", "MidriseApartment", "HighriseApartment", "Retail", "StripMall", "PrimarySchool", "SecondarySchool", "SmallHotel", "LargeHotel", "Hospital", "Outpatient", "Laboratory", "Warehouse", "SuperMarket", "FullServiceRestaurant", "QuickServiceRestaurant", "Courthouse", "LargeDataCenterHighITE", "LargeDataCenterLowITE", "SmallDataCenterHighITE", "SmallDataCenterLowITE"}, selected="LargeOffice")

# ----
# Set Up ROOM or ZONE
dim_y = Slider(10, range=3..10)
number_slider_2 = Slider(3, range=0..10)
domain_box = DomainBox(Base=PlaneXY(0, 0, 0), X=dim_x, Y=dim_y, Z=number_slider_2)
roomsolid = HBRoomFromSolid(geo=flatten(domain_box), program=hb_building_programs, conditioned=True)  # -> out, rooms; plug-in component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

multiplication_2 = Multiplication(A=dim_y, B=0.1)
multiplication_3 = Multiplication(A=number_slider_2, B=0.1)

# ---- group: 4th
point = Point(list_item_2)

# ---- group: 1st
point_2 = Point(list_item)

# ---- group: 2nd
point_3 = Point(list_item_4)

# ---- group: 3rd
point_4 = Point(list_item_3)

# ----
number_slider_3 = Slider(0.5, range=0.2..1.5)

# ----
# Clusters
encoded_image_v_1 = EncodedImageV1()  # -> output_b_channel, list_of_red_values, list_of_green_values, list_of_blue_values
encoded_image_v_2 = EncodedImageV2()  # -> colored_mesh, red_values, green_values, blue_values
encoded_image_v_3 = EncodedImageV3(
    max_heigth_room_z=0,
    max_width_x=0,
    r_color_domain=Domain(0, 1),
    g_color_domain=Domain(0, 1),
    b_color_domain=Domain(0, 1))  # -> encoded_image, r_channel_image, r_channel_values, g_channel_image, faces, g_channel_values, b_channel_image, b_channel_values

skin_resolution = Slider(35, range=0..100)
value_list = ValueList({"Red Channel": 0, "Green Channel": 1, "Blue Channel": 2}, selected="Red Channel")

# ----
# Opening Parameters
window_height = Slider(3, range=0..10)
sill_height = Slider(0.5, range=-0.5..2)
# Skins Typologies
vertical_spacing_between = Slider(0, range=0..10)

horizontal_spacing_between = Slider(10, range=1..10)
ratio_to_the_elevation = Slider(0.89, range=0.05..0.9)

# ----
# Room Dimensions
room_dimension = Merge(Data1=dim_x, Data2=dim_y)

min_max = MinMax()  # -> Minimum, Maximum
height = Panel("3")
python_3_script = Python3Script(x=room_dimension)  # -> out; inputs x: list
# ---------- python_3_script: Python ----------
print(max(x))
# ---------- end python_3_script ----------
panel_11 = Panel(python_3_script)
number_slider_4 = Slider(11, range=2..12)
solid = Slider(0.4, range=0..1, expression="x*100")
number_of_panels = Slider(14, range=0..20)

# ----
# plane to analyze
deconstruct_brep = DeconstructBrep(Brep=domain_box)  # -> Faces, Edges, Vertices
center = Center(Geometry=deconstruct_brep.Faces)  # -> Center, Dimension
deconstruct_7 = Deconstruct(Point=center.Center)  # -> XComponent, YComponent, ZComponent
smaller_than_3 = SmallerThan(FirstNumber=deconstruct_7.ZComponent, SecondNumber=Slider(0.02, range=0..0.1))  # -> SmallerThan, OrEqualTo
cull_pattern_4 = CullPattern(List=deconstruct_brep.Faces, CullPattern=smaller_than_3.SmallerThan)

importstat = LBImportSTAT(stat_file=downloadepw.stat_file)  # -> location, ashrae_zone, koppen_zone, clear_dir_norm_rad, clear_diff_horiz_rad, ann_heat_dday_996, ann_heat_dday_990, ann_cool_dday_004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; plug-in component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
importepw = LBImportEPW(epw_file=downloadepw.epw_file)  # -> location, dry_bulb_temperature, dew_point_temperature, relative_humidity, wind_speed, wind_direction, direct_normal_rad, diffuse_horizontal_rad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; disabled; plug-in component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
number_slider_5 = Slider(3, range=0..10)  # disabled
windprofile = LBWindProfile(met_wind_vel=importepw.wind_speed, met_wind_dir=importepw.wind_direction, profile_height=number_slider_5)  # -> out, wind_speeds, wind_vectors, anchor_pts, mesh_arrows, profile_curve, speed_axis, height_axis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; disabled; plug-in component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
windspeed = LBWindSpeed(met_wind_vel=importepw.wind_speed)  # -> out, air_speed; disabled; plug-in component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
xdata = LBDeconstructData(data=windspeed.air_speed)  # -> header, values; disabled; plug-in component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
data_2 = Data()  # disabled
bounds_4 = Bounds(Numbers=xdata.values)  # disabled
deconstruct_domain = DeconstructDomain(Domain=bounds_4)  # -> Start, End; disabled

solid_2 = Slider(75, range=0..100)
control_wire_display_2 = ControlWireDisplay(WireDisplay="1", AllObjects_Object=skins)
factor = Slider(0.25, range=0..1)
unit_z = UnitZ(Factor=Slider(1, range=0..1))
move = Move(Geometry=cull_pattern_4, Motion=unit_z)  # -> Geometry, Transform
control_wire_display_3 = ControlWireDisplay(WireDisplay="1")

# ----
# Period
number_slider_6 = Slider(1, range=1..12)
number_slider_7 = Slider(1, range=1..31)

# ----
# Comfort param
lb_activities_met_list = LBActivitiesMetList({"Seated", "Standing", "supine"}, selected="Seated")
panel_12 = Panel("0.65")
solarbodypar = LBSolarBodyParameters(posture=lb_activities_met_list, sharp="45")  # -> sol_body_par; plug-in component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

analysisperiod = LBAnalysisPeriod(
    start_month=number_slider_6,
    start_day=number_slider_7,
    start_hour=Slider(8, range=0..23),
    end_month=Slider(12, range=1..12),
    end_day=number_slider_7,
    end_hour=Slider(17, range=0..23))  # -> period, hoys, dates; plug-in component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
adaptpar = LBAdaptiveComfortParameters(
    ashrae_or_en="False",
    neutral_offset=Slider(3, range=0..10),
    avgm_or_runmean="False",
    discr_or_cont_vel="False",
    cold_prevail_limit="15",
    conditioning="0")  # -> adapt_par; plug-in component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
set_group_properties = SetGroupProperties(Color=ColourSwatch(SwatchColor=RGB(216, 255, 184)))
# Adpative thermal comfort
number_slider_8 = Slider(0.2, range=0..3)

# ---- group: ARE YOU SURE ?
toggle = BooleanToggle(False)

# ----
legendpar = LBLegendParameters(min=Slider(25, range=0..100), max=Slider(35, range=0..100))  # -> leg_par; plug-in component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
number_slider_9 = Slider(1, range=0..5)  # disabled
panel_13 = Panel(";")  # disabled
panel_14 = Panel("}")  # disabled
panel_15 = Panel("{")  # disabled
concatenate_5 = Concatenate(FragmentA=panel_15, FragmentB=number_slider_9, FragmentC=panel_14)  # disabled
panel_16 = Panel("6")  # disabled

deconstruct_brep_2 = DeconstructBrep(Brep=domain_box)  # -> Faces, Edges, Vertices
list_item_5 = ListItem(List=deconstruct_brep_2.Faces, Index=Slider(4, range=0..6), Wrap=True)
curve = Curve(list_item_5)
explode = Explode(Curve=curve, Recursive=True)  # -> Segments, Vertices
removeduplicatepts = RemoveDuplicatePts(Points=explode.Vertices, Tolerance=0.01)
center_2 = Center(Geometry=domain_box)  # -> Center, Dimension
division = Division(A=dim_x, B=5)
division_2 = Division(A=dim_y, B=5)
division_3 = Division(A=number_slider_2, B=2)
xy_plane = XYPlane(Origin=removeduplicatepts)
center_box = CenterBox(Base=center_2.Center, X=division_2, Y=division, Z=division_3)
scale_nu = ScaleNU(Geometry=domain_box, Plane=xy_plane, ScaleX=Slider(0.5, range=0..1), ScaleY=Slider(0.5, range=0..1), ScaleZ=1)  # -> Geometry, Transform
boolean_toggle = BooleanToggle(True)

# ----
# Layout Jitter
number_slider_10 = Slider(11, range=0..100)
offset_curve_loose = OffsetCurveLoose(Curve=curve, Distance=Slider(10, range=0..10))
divide_surface_2 = DivideSurface(Surface=list_item_5, UCount=number_slider_10, VCount=number_slider_10)  # -> Points, Normals, Parameters
unit_z_2 = UnitZ(Factor=number_slider_2)
ruled_surface = RuledSurface(CurveA=curve, CurveB=offset_curve_loose)
number_slider_11 = Slider(3, range=0..10)
curve_2 = Curve(list_item_5)
pull_point = PullPoint(Point=divide_surface_2.Points, Geometry=curve_2, ClosestOnly=True)  # -> ClosestPoint, Distance
extrude = Extrude(Base=ruled_surface, Direction=unit_z_2)
smaller_than_4 = SmallerThan(FirstNumber=pull_point.Distance, SecondNumber="0.01")  # -> SmallerThan, OrEqualTo
gene_pool = GenePool(Decimals=2, Maximum=100, Minimum=0, Value=[48.97, 41.82, 80.88, 21.44, 74.67])
number_slider_12 = Slider(72, range=0..100)
cull_pattern_5 = CullPattern(List=divide_surface_2.Points, CullPattern=invert(smaller_than_4.SmallerThan))  # -> flatten(List)
division_4 = Division(A=dim_x, B=5)
division_5 = Division(A=dim_y, B=5)
division_6 = Division(A=number_slider_2, B=2)
list_item_6 = ListItem(List=cull_pattern_5, Index=gene_pool, Wrap=True)
removeduplicatepts_2 = RemoveDuplicatePts(Points=list_item_6, Tolerance=Slider(2, range=0..10))
unit_z_3 = UnitZ(Factor=Slider(1.5, range=0..10))
move_2 = Move(Geometry=removeduplicatepts_2, Motion=unit_z_3)  # -> Geometry, Transform
center_box_2 = CenterBox(Base=move_2.Geometry, X=division_5, Y=division_4, Z=division_6)
solid_union = SolidUnion(Breps=center_box_2)
solid_difference = SolidDifference(BrepsA=solid_union, BrepsB=extrude)

solid_difference_2 = SolidDifference(BrepsA=scale_nu.Geometry, BrepsB=center_box_2)
roomsolid_2 = HBRoomFromSolid(geo=flatten(solid_difference_2), program=hb_building_programs, conditioned=True)  # -> out, rooms; plug-in component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
roomsolid_3 = HBRoomFromSolid(geo=flatten(solid_difference), program=hb_building_programs, conditioned=True)  # -> out, rooms; plug-in component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
intsolid = HBIntersectSolids(rooms=flatten([roomsolid_2.rooms, roomsolid_3.rooms]), run=boolean_toggle)  # -> int_rooms; plug-in component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
solveadj = HBSolveAdjacency(rooms=flatten(intsolid), adiabatic=boolean_toggle, run=boolean_toggle)  # -> out, adj_rooms; plug-in component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
vizquick = HBVisualizeQuick(hb_objs=flatten([roomsolid_2.rooms, roomsolid_3.rooms]))  # -> geo; plug-in component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
vizquick_2 = HBVisualizeQuick(hb_objs=flatten(solveadj.adj_rooms))  # -> geo; plug-in component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

# ----
# Windows
facparam = HBFacadeParameters(north=ratio_to_the_elevation, east=ratio_to_the_elevation, south=ratio_to_the_elevation, west=ratio_to_the_elevation)  # -> fac_par; plug-in component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
aperturesbyratio = HBAperturesByRatio(
    hb_objs=flatten(solveadj.adj_rooms),
    ratio=facparam,
    subdivide=Slider(2, range=0..10),
    win_height=window_height,
    sill_height=sill_height,
    horiz_separ=horizontal_spacing_between,
    vert_separ=vertical_spacing_between)  # -> out, hb_objs; plug-in component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

decnstrobj = HBDeconstructObject(hb_obj=aperturesbyratio.hb_objs)  # -> flatten(faces), flatten(apertures), doors, shades; plug-in component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
hb_construction_types = HBConstructionTypes({"SteelFramed", "WoodFramed", "Mass", "Metal Building"}, selected="SteelFramed")
vizquick_3 = HBVisualizeQuick(hb_objs=flatten(decnstrobj.apertures))  # -> geo; plug-in component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
vizquick_4 = HBVisualizeQuick(hb_objs=flatten(decnstrobj.faces))  # -> geo; plug-in component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
aperture = HBAperture(geo=vizquick_3)  # -> out, apertures; plug-in component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
face = HBFace(geo=vizquick_4, bc="adiabatic")  # -> out, faces; plug-in component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

list_item_7 = ListItem(List=vizquick_2, Index=Slider(2, range=0..10), Wrap=True)

area = Area(Geometry=vizquick_4)  # -> Area, Centroid
deconstruct_8 = Deconstruct(Point=area.Centroid)  # -> XComponent, YComponent, ZComponent
sort_list = SortList(Keys=deconstruct_8.ZComponent, ValuesValuesA=deconstruct_8.ZComponent)  # -> Keys, ValuesValuesA
list_item_8 = ListItem(List=sort_list.ValuesValuesA, Index=0, Wrap=True)  # -> Item1, Item
equality_within_tolerance = EqualityWithinTolerance(FirstNumber=list_item_8.Item1, SecondNumber=deconstruct_8.ZComponent, Tolerance=0.01)  # -> Equality, Inequality
equality_within_tolerance_2 = EqualityWithinTolerance(FirstNumber=list_item_8.Item, SecondNumber=deconstruct_8.ZComponent, Tolerance=0.01)  # -> Equality, Inequality
gate_or = GateOr(A=equality_within_tolerance.Equality, B=equality_within_tolerance_2.Equality)
cull_pattern_6 = CullPattern(List=vizquick_4, CullPattern=invert(gate_or))
area_2 = Area(Geometry=cull_pattern_6)  # -> Area, Centroid
offset_curve = OffsetCurve(Curve=curve, Distance=expr("-x", Slider(0.5, range=0..1)), Corners=1)
project = Project(Geometry=area_2.Centroid, Plane=curve)  # -> Geometry, Transform
point_in_curve = PointInCurve(Point=project.Geometry, Curve=offset_curve)  # -> Relationship, Point
cull_pattern_7 = CullPattern(List=cull_pattern_6, CullPattern=invert(point_in_curve.Relationship))

bounding_rectangle = BoundingRectangle(Geometry=vizquick_2, Plane=PlaneXY(0, 0, 0), Axis=0, Slide=0, Union=True)  # -> Bounding, DimensionX, DimensionY
deconstruct_brep_3 = DeconstructBrep(Brep=vizquick_2)  # -> Faces, Edges, Vertices
vizquick_5 = HBVisualizeQuick(hb_objs=flatten(aperturesbyratio.hb_objs))  # -> geo; plug-in component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
area_3 = Area(Geometry=deconstruct_brep_3.Faces)  # -> Area, Centroid
vizquick_6 = HBVisualizeQuick(hb_objs=flatten(decnstrobj.apertures))  # -> geo; plug-in component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
brep_brep = BrepBrep(BrepA=vizquick_2, BrepB=bounding_rectangle.Bounding)  # -> Curves, Points
deconstruct_9 = Deconstruct(Point=area_3.Centroid)  # -> XComponent, YComponent, flatten(ZComponent)
min_max_2 = MinMax(Number=deconstruct_9.ZComponent)  # -> Minimum, Maximum
center_3 = Center(Geometry=vizquick_3)  # -> Center, Dimension
equality_3 = Equality(FirstNumber=min_max_2.Minimum, SecondNumber=deconstruct_9.ZComponent)  # -> Equality, Inequality
equality_4 = Equality(FirstNumber=min_max_2.Maximum, SecondNumber=deconstruct_9.ZComponent)  # -> Equality, Inequality
deconstruct_vector = DeconstructVector(Vector=center_3.Center)  # -> XComponent, YComponent, ZComponent
gate_or_2 = GateOr(A=equality_3.Equality, B=equality_4.Equality)
cull_pattern_8 = CullPattern(List=flatten(deconstruct_brep_3.Faces), CullPattern=invert(gate_or_2))
equality_5 = Equality(FirstNumber=deconstruct_vector.XComponent, SecondNumber=dim_x)  # -> Equality, Inequality
equality_6 = Equality(FirstNumber=deconstruct_vector.YComponent, SecondNumber=dim_y)  # -> Equality, Inequality
list_item_9 = ListItem(List=cull_pattern_8, Index=Slider(4, range=0..10), Wrap=True)
cull_pattern_9 = CullPattern(List=cull_pattern_6, CullPattern=point_in_curve.Relationship)
area_4 = Area(Geometry=cull_pattern_9)  # -> Area, Centroid
evaluate_surface = EvaluateSurface(Surface=reparameterize(cull_pattern_9), Point="0.5,0.5,0")  # -> Point, Normal, UDirection, VDirection, Frame
cull_pattern_10 = CullPattern(List=vizquick_3, CullPattern=invert(deconstruct_vector.YComponent))
face_a_windows = Geometry(cull_pattern_10)
cull_pattern_11 = CullPattern(List=vizquick_3, CullPattern=equality_5.Equality)
cull_pattern_12 = CullPattern(List=vizquick_3, CullPattern=equality_6.Equality)
facade_windows = Geometry(cull_pattern_12)
cull_pattern_13 = CullPattern(List=vizquick_3, CullPattern=invert(deconstruct_vector.XComponent))
cull_duplicates = CullDuplicates(Points=area_4.Centroid, Tolerance=0.1, CullMode=3)  # -> Points, Indices, Valence
vector_display = VectorDisplay(Anchor=evaluate_surface.Point, Vector=evaluate_surface.Normal)

# ----
# Encoded Image - Face D
# Inputs: Encoded Image
# Encoded Image Boundaries
# Encoded Image Resolution
image_location = Slider(5, range=0..10)
resolution = Panel("256")
dom_2 = ConstructDomain(DomainStart="-8", DomainEnd="8")
panel_17 = Panel("70 to 255")
panel_18 = Panel("255 to 30")

# ----
# Encoded Image - Face C
# Inputs: Encoded Image
# Encoded Image Boundaries
# Encoded Image Resolution
image_location_2 = Slider(5, range=0..10)
dom_3 = ConstructDomain(DomainStart="-8", DomainEnd="8")
panel_22 = Panel("30 to 255")

# ----
# Facade as a shader
distance_of_shaders = Slider(0.53, range=0..1.5)
# Inputs: Skins
number_slider_13 = Slider(0, range=0..5)
viznorm = HBVisualizeNormals(hb_objs=roomsolid.rooms)  # -> points, vectors; plug-in component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

# ---- group: Vector
list_item_10 = ListItem(List=viznorm.vectors, Index=number_slider_13, Wrap=True)  # -> Item, Item1, Item2, Item3
amplitude = Amplitude(Vector=list_item_10.Item, Amplitude=number_slider_3)
amplitude_2 = Amplitude(Vector=list_item_10.Item1, Amplitude=number_slider_3)
amplitude_3 = Amplitude(Vector=list_item_10.Item2, Amplitude=number_slider_3)
amplitude_4 = Amplitude(Vector=list_item_10.Item3, Amplitude=number_slider_3)

# ---- group: Faces
list_item_11 = ListItem(List=deconstruct_brep.Faces, Index=number_slider_13, Wrap=True)  # -> Item, Item1, Item2, Item3

# ----
# Encoded Image Boundaries
panel_23 = Panel("-8")
dom_4 = ConstructDomain(DomainStart=panel_23, DomainEnd="8")
rectangle_2 = Rectangle(Plane=list_item_11.Item, XSize=dom_4, YSize=dom_4, Radius=0)  # -> Rectangle, Length

move_3 = Move(Geometry=list_item_11.Item, Motion=amplitude)  # -> Geometry, Transform
move_4 = Move(Geometry=list_item_11.Item1, Motion=amplitude_2)  # -> Geometry, Transform
move_5 = Move(Geometry=list_item_11.Item2, Motion=amplitude_3)  # -> Geometry, Transform
move_6 = Move(Geometry=list_item_11.Item3, Motion=amplitude_4)  # -> Geometry, Transform

back_room = Geometry(list_item_11.Item)
face_a = Geometry(list_item_11.Item)
face_c = Geometry(list_item_11.Item2)
cluster = Cluster_4(u_count=number_slider_4, v_count=number_slider_4, surface=move_3.Geometry)  # -> list, area_3; disabled
skins = Skins(surface=move_3.Geometry, solid=solid, nbr_of_panels=number_of_panels)
cluster_2 = Cluster_4(u_count=number_slider_4, v_count=number_slider_4, surface=move_3.Geometry)  # -> list, area_3
cluster_3 = Cluster_4(u_count=number_slider_4, v_count=number_slider_4, surface=move_3.Geometry)  # -> list, area_3
cluster_4 = Cluster_4(u_count=number_slider_4, v_count=number_slider_4, surface=move_4.Geometry)  # -> list, area_3; disabled
cluster_5 = Cluster_4(u_count=number_slider_4, v_count=number_slider_4, surface=move_5.Geometry)  # -> list, area_3; disabled
cluster_6 = Cluster_4(u_count=number_slider_4, v_count=number_slider_4, surface=move_6.Geometry)  # -> list, area_3
geometry = Geometry(list_item_11.Item3)
face_b = Geometry(list_item_11.Item1)
merge = Merge(Data1=cluster_2.list, Data2=cluster_4.list, Data3=cluster_5.list, Data4=cluster_6.list)

# ---- group: HB Shaders
srf = Surface(merge)
shade = HBShade(geo=flatten(srf))  # -> out, shades; plug-in component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
area_5 = Area(Geometry=flatten(srf))  # -> Area, Centroid

# ----
# Model
model = HBModel(rooms=flatten(aperturesbyratio.hb_objs), shades=flatten(shade.shades), apertures=flatten(aperture.apertures))  # -> out, model; plug-in component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
vizall = HBVisualizeAll(hb_objs=flatten(model.model))  # -> geo; plug-in component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
vizwiref = HBVisualizeWireframe(hb_objs=flatten(model.model))  # -> geo; plug-in component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

hb_face_attributes = HBFaceAttributes({"Display Name": "display_name", "Simulation Name (Identifier)": "identifier", "Boundary Condition": "boundary_condition", "Has Parent": "has_parent", "Parent": "parent", "Azimuth": "azimuth", "Altitude": "altitude", "Area": "area", "Perimeter": "perimeter", "Face Type": "type", "Aperture Is Operable": "is_operable", "Door Is Glass": "is_glass"}, selected="Boundary Condition")
# Faces labels
lablefaces = HBLabelFaces(hb_objs=flatten(model.model), attribute=hb_face_attributes)  # -> label_text, base_pts, labels, wire_frame; plug-in component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

# ----
# Visualize
vizbytype = HBVisualizeByType(hb_objs=model.model)  # -> walls, interior_walls, roofs, ceilings, exterior_floors, interior_floors, air_walls, apertures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; plug-in component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
data_3 = Data(vizbytype.outdoor_shades)
mesh_edges = MeshEdges(Mesh=data_3)  # -> NakedEdges, InteriorEdges, NonManifoldEdges
data_4 = Data(mesh_edges.NakedEdges)
mesh = Mesh(data_3)

rectangle_3 = Rectangle(Plane=move_6.Geometry, XSize=dom_2, YSize=dom_2, Radius=0)  # -> Rectangle, Length

# ----
# Encoded Image - Face B
# Inputs: Encoded Image
# Encoded Image Boundaries
# Encoded Image Resolution
resolution_3 = Panel("256")
image_location_3 = Slider(5, range=0..10)
dom_5 = ConstructDomain(DomainStart="-8", DomainEnd="8")
rectangle_4 = Rectangle(Plane=move_4.Geometry, XSize=dom_5, YSize=dom_5, Radius=0)  # -> Rectangle, Length

# ----
# Inputs: Encoded Image
resolution_4 = Panel("128")
image_location_4 = Slider(5, range=0..10)

rectangle_5 = Rectangle(Plane=move_5.Geometry, XSize=dom_3, YSize=dom_3, Radius=0)  # -> Rectangle, Length
mesh_plane = MeshPlane(Boundary=rectangle_5.Rectangle, WidthCount=resolution_4, HeightCount=resolution_4)  # -> Mesh, Area
mesh_encoded_image = Mesh(mesh_plane.Mesh)
deconstruct_mesh_4 = DeconstructMesh(Mesh=mesh_encoded_image)  # -> Vertices, Faces, Colours, Normals

mesh_plane_2 = MeshPlane(Boundary=rectangle_3.Rectangle, WidthCount=resolution_4, HeightCount=resolution_4)  # -> Mesh, Area
mesh_encoded_image_2 = Mesh(mesh_plane_2.Mesh)
deconstruct_mesh_5 = DeconstructMesh(Mesh=mesh_encoded_image_2)  # -> Vertices, Faces, Colours, Normals

# ----
# Encoded Image Resolution
mesh_plane_3 = MeshPlane(Boundary=rectangle_2.Rectangle, WidthCount=resolution_4, HeightCount=resolution_4)  # -> Mesh, Area

mesh_plane_4 = MeshPlane(Boundary=rectangle_4.Rectangle, WidthCount=resolution_4, HeightCount=resolution_4)  # -> Mesh, Area
mesh_encoded_image_3 = Mesh(mesh_plane_4.Mesh)
deconstruct_mesh_6 = DeconstructMesh(Mesh=mesh_encoded_image_3)  # -> Vertices, Faces, Colours, Normals

mesh_encoded_image_4 = Mesh(mesh_plane_3.Mesh)

back_room_2 = Geometry(list_item_11.Item1)
face_d = Geometry(list_item_11.Item3)

# ----
# Encoded Image - Face A
panel_24 = Panel("255 to 30")
deconstruct_mesh_7 = DeconstructMesh(Mesh=mesh_encoded_image_4)  # -> Vertices, Faces, Colours, Normals

cluster_7 = Cluster_3(mesh_vertices=deconstruct_mesh_7.Vertices, max_width_x=dim_x, max_heigth_room_z=height)  # -> u_count, v_count

encoded_image_v_4 = EncodedImageV4(
    u_count=cluster_7.u_count,
    v_count=cluster_7.v_count,
    mersh_vectors=deconstruct_mesh_7.Vertices,
    dist_facade_skin=image_location_4,
    red_channel_precision="2",
    facade_window_srf=face_a_windows,
    r_color_domain=panel_24,
    facade_surface=face_a,
    skin_typology_srf=cluster_2.list,
    g_color_domain="30 to 255",
    back_room_wall_srf=move_5.Geometry,
    b_color_domain="30 to 255",
    max_room_distance=python_3_script)  # -> encoded_image, r_channel_image, r_channel_values, g_channel_image, g_channel_values, b_channel_image, b_channel_values, shaders_faces

encoded_image_v_4_2 = EncodedImageV4(
    u_count=cluster_7.u_count,
    v_count=cluster_7.v_count,
    mersh_vectors=deconstruct_mesh_4.Vertices,
    dist_facade_skin=image_location_2,
    red_channel_precision="2",
    facade_window_srf=facade_windows,
    r_color_domain="255 to 30",
    facade_surface=face_c,
    skin_typology_srf=cluster_5.list,
    g_color_domain="30 to 255",
    back_room_wall_srf=back_room,
    b_color_domain="30 to 255",
    max_room_distance=python_3_script)  # -> encoded_image, r_channel_image, r_channel_values, g_channel_image, g_channel_values, b_channel_image, b_channel_values, shaders_faces
panel_25 = Panel(encoded_image_v_4.b_channel_values)
construct_mesh = ConstructMesh(Vertices=deconstruct_mesh_4.Vertices, Faces=deconstruct_mesh_4.Faces, Colours=encoded_image_v_4_2.encoded_image)
encoded_image_v_4_3 = EncodedImageV4(
    u_count=cluster_7.u_count,
    v_count=cluster_7.v_count,
    mersh_vectors=deconstruct_mesh_6.Vertices,
    dist_facade_skin=image_location_3,
    red_channel_precision="2",
    facade_window_srf=cull_pattern_11,
    r_color_domain="255 to 30",
    facade_surface=face_b,
    skin_typology_srf=cluster_4.list,
    g_color_domain="30 to 255",
    back_room_wall_srf=geometry,
    b_color_domain="30 to 255",
    max_room_distance=python_3_script)  # -> encoded_image, r_channel_image, r_channel_values, g_channel_image, g_channel_values, b_channel_image, b_channel_values, shaders_faces
construct_mesh_2 = ConstructMesh(Vertices=deconstruct_mesh_7.Vertices, Faces=deconstruct_mesh_7.Faces, Colours=encoded_image_v_4.encoded_image)
construct_mesh_3 = ConstructMesh(Vertices=deconstruct_mesh_6.Vertices, Faces=deconstruct_mesh_6.Faces, Colours=encoded_image_v_4_3.encoded_image)

# ---- group: RB Channel
colour_rgb = ColourRGB(Alpha=255, Red=encoded_image_v_4_2.r_channel_values, Green=0, Blue=encoded_image_v_4_2.b_channel_values)
construct_mesh_4 = ConstructMesh(Vertices=deconstruct_mesh_7.Vertices, Faces=deconstruct_mesh_7.Faces, Colours=colour_rgb)

colour_rgb_2 = ColourRGB(Alpha=255, Red=encoded_image_v_4.r_channel_values, Green=0, Blue=encoded_image_v_4.b_channel_values)
construct_mesh_5 = ConstructMesh(Vertices=deconstruct_mesh_7.Vertices, Faces=deconstruct_mesh_7.Faces, Colours=colour_rgb_2)

# ---- group: G Channel
colour_rgb_3 = ColourRGB(Alpha=255, Red=0, Green=encoded_image_v_4.g_channel_values, Blue=0)
construct_mesh_6 = ConstructMesh(Vertices=deconstruct_mesh_7.Vertices, Faces=deconstruct_mesh_7.Faces, Colours=encoded_image_v_4.g_channel_image)

colour_rgb_4 = ColourRGB(Alpha=255, Red=0, Green=0, Blue=0)
construct_mesh_7 = ConstructMesh(Vertices=deconstruct_mesh_7.Vertices, Faces=deconstruct_mesh_7.Faces, Colours=encoded_image_v_4_2.g_channel_image)

# ---- group: RB Channel
colour_rgb_5 = ColourRGB(Alpha=255, Red=encoded_image_v_4_3.r_channel_values, Green=0, Blue=encoded_image_v_4_3.b_channel_values)
construct_mesh_8 = ConstructMesh(Vertices=deconstruct_mesh_7.Vertices, Faces=deconstruct_mesh_7.Faces, Colours=colour_rgb_5)

# ---- group: G Channel
colour_rgb_6 = ColourRGB(Alpha=255, Red=0, Green=encoded_image_v_4_3.g_channel_values, Blue=0)
construct_mesh_9 = ConstructMesh(Vertices=deconstruct_mesh_7.Vertices, Faces=deconstruct_mesh_7.Faces, Colours=encoded_image_v_4_3.g_channel_image)

# ----
area_6 = Area(Geometry=construct_mesh)  # -> Area, Centroid
scale = Scale(Geometry=construct_mesh, Center=area_6.Centroid, Factor=factor)  # -> Geometry, Transform

# ---- group: Rotate & Scale
cluster_8 = Cluster(geometry=construct_mesh_4, factor=factor, point_b=point_4)
cluster_9 = Cluster(geometry=construct_mesh_7, factor=factor, point_b=point_4)

cluster_10 = Cluster(geometry=construct_mesh_3, factor=factor, point_b=point_3)
cluster_11 = Cluster(geometry=construct_mesh_8, factor=factor, point_b=point_3)
cluster_12 = Cluster(geometry=construct_mesh_9, factor=factor, point_b=point_3)

# ----
area_7 = Area(Geometry=construct_mesh_2)  # -> Area, Centroid
move_to_point = MoveToPoint(Geometry=scale.Geometry, PointA=area_6.Centroid, PointB=point_4)  # -> Moved, Vector, Transform
scale_2 = Scale(Geometry=construct_mesh_2, Center=area_7.Centroid, Factor=factor)  # -> Geometry, Transform

# ---- group: Rotate & Scale
cluster_13 = Cluster(geometry=construct_mesh_5, factor=factor, point_b=point_2)
cluster_14 = Cluster(geometry=construct_mesh_6, factor=factor, point_b=point_2)

# ----
move_to_point_2 = MoveToPoint(Geometry=scale_2.Geometry, PointA=area_7.Centroid, PointB=point_2)  # -> Moved, Vector, Transform

encoded_image_v_4_4 = EncodedImageV4(
    u_count=cluster_7.u_count,
    v_count=cluster_7.v_count,
    mersh_vectors=deconstruct_mesh_5.Vertices,
    dist_facade_skin=image_location_2,
    red_channel_precision="2",
    facade_window_srf=cull_pattern_13,
    r_color_domain="255 to 30",
    facade_surface=face_d,
    skin_typology_srf=cluster_6.list,
    g_color_domain="30 to 255",
    back_room_wall_srf=back_room_2,
    b_color_domain="30 to 255",
    max_room_distance=python_3_script)  # -> encoded_image, r_channel_image, r_channel_values, g_channel_image, g_channel_values, b_channel_image, b_channel_values, shaders_faces
construct_mesh_10 = ConstructMesh(Vertices=deconstruct_mesh_5.Vertices, Faces=deconstruct_mesh_5.Faces, Colours=encoded_image_v_4_4.encoded_image)

# ---- group: G Channel
colour_rgb_7 = ColourRGB(Alpha=255, Red=0, Green=0, Blue=0)
construct_mesh_11 = ConstructMesh(Vertices=deconstruct_mesh_5.Vertices, Faces=deconstruct_mesh_5.Faces, Colours=encoded_image_v_4_4.g_channel_image)

# ---- group: RB Channel
colour_rgb_8 = ColourRGB(Alpha=255, Red=encoded_image_v_4_4.r_channel_values, Green=0, Blue=encoded_image_v_4_4.b_channel_values)
construct_mesh_12 = ConstructMesh(Vertices=deconstruct_mesh_5.Vertices, Faces=deconstruct_mesh_5.Faces, Colours=colour_rgb_8)

# ---- group: Scale & Orient
rotate = Rotate(Geometry=construct_mesh_10, Angle=1.570796327, Plane=PlaneXY(0, 0, 0))  # -> Geometry, Transform
cluster_15 = Cluster_2(geometry=construct_mesh_12, factor=factor, point_b=point)
cluster_16 = Cluster_2(geometry=construct_mesh_11, factor=factor, point_b=point)

# ----
area_8 = Area(Geometry=rotate.Geometry)  # -> Area, Centroid
scale_3 = Scale(Geometry=rotate.Geometry, Center=area_8.Centroid, Factor=factor)  # -> Geometry, Transform
move_to_point_3 = MoveToPoint(Geometry=scale_3.Geometry, PointA=area_8.Centroid, PointB=point)  # -> Moved, Vector, Transform

merge_2 = Merge(Data1=move_to_point_2.Moved, Data2=cluster_10, Data3=move_to_point.Moved, Data4=move_to_point_3.Moved)
list_item_12 = ListItem(List=merge_2, Index=0, Wrap=True)  # -> Item, Item1, Item2, Item3

# ---- group: RB Channel
merge_3 = Merge(Data1=cluster_13, Data2=cluster_11, Data3=cluster_8, Data4=cluster_15)  # -> graft(Result)
area_9 = Area(Geometry=merge_3)  # -> Area, Centroid
list_item_13 = ListItem(List=merge_3, Index=0, Wrap=True)  # -> Item, Item1, Item2, Item3
rotate_2 = Rotate(Geometry=merge_3, Angle=1.570796327, Plane=area_9.Centroid)  # -> Geometry, Transform

# ---- group: G Channel
merge_4 = Merge(Data1=cluster_14, Data2=cluster_12, Data3=cluster_9, Data4=cluster_16)
area_10 = Area(Geometry=merge_4)  # -> Area, Centroid
rotate_3 = Rotate(Geometry=merge_4, Angle=1.570796327, Plane=area_10.Centroid)  # -> Geometry, Transform
list_item_14 = ListItem(List=merge_4, Index=0, Wrap=True)  # -> Item, Item1, Item2, Item3

# ---- group: 4 MESH
mesh_2 = Mesh([move_to_point_3.Moved, move_to_point.Moved, move_to_point_2.Moved, cluster_10])

# ----
mesh_join_4 = MeshJoin(Meshes=merge_2)  # -> flatten(Mesh)
mesh_join_5 = MeshJoin(Meshes=flatten(rotate_2.Geometry))  # -> flatten(Mesh)
mesh_join_6 = MeshJoin(Meshes=flatten(rotate_3.Geometry))  # -> flatten(Mesh)

# ----
# Sensor Grid
number_slider_14 = Slider(0.5, range=0..10)
genpts = LBGeneratePointGrid(geometry=move.Geometry, grid_size=number_slider_14)  # -> points, vectors, face_areas, mesh; plug-in component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
points = Data(genpts.points)

rebuild_mesh = RebuildMesh(
    Mesh=genpts.mesh,
    RebuildNormals=False,
    CullUnused=False,
    UnifyNormals=False,
    FlipNormals=True,
    IdenticalCombine=False,
    WeldVertices=0)

sensorgrid = HBSensorGrid(positions=points, mesh=rebuild_mesh)  # -> grid; plug-in component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
assigngridsviews = HBAssignGridsAndViews(model=model.model, grids=flatten(sensorgrid))  # -> model; plug-in component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

# ----
# Analysis parameters:
# 
# HB room - Indoor analysis:
# Apreture testing location : South
# period: Annual
# Wind speed: 0.2
# human body parameters: Seated - facing side way to the window
adaptivemap = HBAdaptiveComfortMap(
    model=assigngridsviews,
    epw=downloadepw.epw_file,
    ddy=downloadepw.ddy_file,
    run_period=analysisperiod.period,
    air_speed=number_slider_8,
    comfort_par=adaptpar,
    solar_body_par=solarbodypar,
    run=toggle)  # -> out, env_conds, op_temp, condition, deg_neut, TCP, HSP, CSP; plug-in component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

heatmap = LBSpatialHeatmap(values=adaptivemap.CSP, mesh=rebuild_mesh)  # -> mesh, legend, title, colors, legend_par, vis_set; plug-in component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
heatmap_2 = LBSpatialHeatmap(values=adaptivemap.HSP, mesh=rebuild_mesh)  # -> mesh, legend, title, colors, legend_par, vis_set; plug-in component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
heatmap_3 = LBSpatialHeatmap(values=adaptivemap.TCP, mesh=rebuild_mesh)  # -> mesh, legend, title, colors, legend_par, vis_set; plug-in component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

envmtx = HBReadEnvironmentMatrix(env_conds=adaptivemap.env_conds, load=Toggle(True))  # -> comf_mtx; plug-in component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
thermalmtx = HBReadThermalMatrix(comf_result=adaptivemap.condition, load=Toggle(True))  # -> comf_mtx; plug-in component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
vizthermalmap = HBVisualizeThermalMap(comf_mtx=envmtx, mesh=flatten(rebuild_mesh), legend_par=legendpar)  # -> out, mesh, legend, title, colors, values; plug-in component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
average = Average(Input=adaptivemap.HSP)
average_2 = Average(Input=adaptivemap.TCP)
average_3 = Average(Input=vizthermalmap.values)
wallacei_x = WallaceiX(
    Genes=[dim_x, dim_y, number_slider_3, number_slider_4],
    Objectives=[average_3, average_2, average],
    Phenotype=[vizthermalmap.mesh, brep_brep.Curves, mesh_join_4, mesh_join_5, mesh_join_6],
    allFitness="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",
    allFrontIdx="0|0;0|2;0|3;0|13;0|14;0|15;0|16;0|18;0|19;0|20;0|22;0|23;0|25;0|26;0|27;0|28;0|30;0|31;0|32;0|35;0|36;0|37;0|38;0|40;0|41;0|43;0|49;0|51;0|55;0|56;0|58;0|60;0|61;0|62;0|65;0|68;0|69;0|73;0|76;0|77;0|81;0|82;0|84;0|86;0|88;0|91;0|92;0|93;0|96;0|97;0|98;0|99",
    allGenomes="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",
    curFrontIdx="0|0;0|2;0|3;0|13;0|14;0|15;0|16;0|18;0|19;0|20;0|22;0|23;0|25;0|26;0|27;0|28;0|30;0|31;0|32;0|35;0|36;0|37;0|38;0|40;0|41;0|43;0|49;0|51;0|55;0|56;0|58;0|60;0|61;0|62;0|65;0|68;0|69;0|73;0|76;0|77;0|81;0|82;0|84;0|86;0|88;0|91;0|92;0|93;0|96;0|97;0|98;0|99",
    curFrontIdxSave="0|0;0|2;0|3;0|13;0|14;0|15;0|16;0|18;0|19;0|20;0|22;0|23;0|25;0|26;0|27;0|28;0|30;0|31;0|32;0|35;0|36;0|37;0|38;0|40;0|41;0|43;0|49;0|51;0|55;0|56;0|58;0|60;0|61;0|62;0|65;0|68;0|69;0|73;0|76;0|77;0|81;0|82;0|84;0|86;0|88;0|91;0|92;0|93;0|96;0|97;0|98;0|99",
    popGen="100,1",
    total="13589031",
    wlcDone=True)  # -> WallaceiGenomes, FitnessValues, Data, Phenotypes

number_slider_15 = Slider(20, range=0..100)  # disabled
number_slider_16 = Slider(0.1, range=0..0.1)  # disabled
distribute_to_grid = DistributeToGrid(
    FitnessValues=wallacei_x.FitnessValues,
    WallaceiPhenotypes=wallacei_x.Phenotypes,
    SizeOfTheGridInTheXDirection=number_slider_15,
    SizeOfTheGridInTheYDirection=number_slider_15,
    OutputOptions=0)  # -> DistributedFitnessValues, DistributedData, DistributedGeometries, DistributedMeshes, DistributedNumbers, GridLocations; disabled
swatch = ColourSwatch(SwatchColor=RGB(0, 0, 0))  # disabled
tag = TextTag3D(Text=distribute_to_grid.DistributedFitnessValues, Size=number_slider_16, Colour=swatch, Justification=7)  # disabled

round_to_decimal_place = RoundToDecimalPlace(NumberX=average_3, DecimalPlace=Slider(1, range=0..10), RoundType=0)  # -> Rounded, Difference
tag_2 = TextTag3D(
    Location=points,
    Text=round_to_decimal_place.Rounded,
    Size=Slider(0.1, range=0..0.1),
    Colour=ColourSwatch(SwatchColor=RGB(0, 0, 0)),
    Justification=7)

decode_phenotype = DecodePhenotype(WallaceiPhenotype=wallacei_x.Phenotypes)  # -> simplify(GeometriesList), simplify(MeshesList), NumbersList, TextList; disabled
tree_branch = TreeBranch(Tree=decode_phenotype.MeshesList, Path=concatenate_5, MaintainPaths=True)  # disabled
partition_list = PartitionList(List=flatten(decode_phenotype.MeshesList), Size=panel_16)  # disabled
panel_26 = Panel(partition_list)

entwine = Entwine(
    Branch00=vizthermalmap.mesh,
    Branch01=mesh_join_4,
    Branch02=mesh_join_6,
    Branch03=vizthermalmap.mesh,
    Branch04=construct_mesh_6,
    FlattenInputs=True)
data_recorder = DataRecorder(entwine, DataLimit=-10, RecordData=False)
panel_27 = Panel(entwine)
explode_tree = ExplodeTree(Data=data_recorder)  # -> Branch0, Branch1, Branch2, Branch3, Branch4, Branch5, Branch6, Branch7, Branch8
list_item_15 = ListItem(List=explode_tree.Branch0, Index=0, Wrap=True)
list_item_16 = ListItem(List=explode_tree.Branch1, Index="1", Wrap=True)
list_item_17 = ListItem(List=explode_tree.Branch2, Index="2", Wrap=True)
number_slider_17 = Slider(100, range=0..100)
list_item_18 = ListItem(List=flatten(list_item_15), Index=number_slider_17, Wrap=True)
list_item_19 = ListItem(List=flatten(list_item_17), Index=number_slider_17, Wrap=True)
list_item_20 = ListItem(List=flatten(list_item_16), Index=number_slider_17, Wrap=True)
scale_4 = Scale(Geometry=list_item_18, Center=Point(0, 0, 0), Factor=Slider(0.5, range=0..1))  # -> Geometry, Transform
yz_plane = YZPlane(Origin=Point(0, 0, 0))
rotate_4 = Rotate(Geometry=list_item_20, Angle=1.570796327, Plane=yz_plane)  # -> Geometry, Transform
center_4 = Center(Geometry=scale_4.Geometry)  # -> Center, Dimension
unit_x = UnitX(Factor="-4")
bounding_rectangle_2 = BoundingRectangle(Geometry=list_item_20, Plane=PlaneXY(0, 0, 0), Axis=0, Slide=0, Union=True)  # -> Bounding, DimensionX, DimensionY
dom_6 = ConstructDomain(DomainStart="-4", DomainEnd="4")
move_7 = Move(Geometry=list_item_20, Motion=unit_x)  # -> Geometry, Transform
move_to_point_4 = MoveToPoint(Geometry=scale_4.Geometry, PointA=center_4.Center)  # -> Moved, Vector, Transform
rectangle_6 = Rectangle(Plane=PlaneXY(0, 0, 0), XSize=dom_6, YSize=dom_6, Radius=0)  # -> Rectangle, Length
rotate_axis = RotateAxis(Geometry=move_to_point_4.Moved, Angle=1.570796327, Axis=Line((0, 0, 0), (10, 0, 0)))  # -> Geometry, Transform
unit_x_2 = UnitX(Factor="8")
mesh_3 = Mesh(flatten([move_7.Geometry, rotate_axis.Geometry]))
mesh_plane_5 = MeshPlane(Boundary=rectangle_6.Rectangle, WidthCount="256", HeightCount="256")  # -> Mesh, Area
move_8 = Move(Geometry=mesh_plane_5.Mesh, Motion=unit_x_2)  # -> Geometry, Transform
move_9 = Move(Geometry=rectangle_6.Rectangle, Motion=unit_x_2)  # -> Geometry, Transform
bounding_rectangle_3 = BoundingRectangle(Geometry=scale_4.Geometry, Plane=PlaneXY(0, 0, 0), Axis=0, Slide=0, Union=True)  # -> Bounding, DimensionX, DimensionY
deconstruct_mesh_8 = DeconstructMesh(Mesh=move_8.Geometry)  # -> Vertices, Faces, Colours, Normals
deconstruct_mesh_9 = DeconstructMesh(Mesh=mesh_plane_5.Mesh)  # -> Vertices, Faces, Colours, Normals
orient = Orient(Geometry=scale_4.Geometry, Source=bounding_rectangle_3.Bounding, Target=move_9.Geometry)  # -> Geometry, Transform
orient_2 = Orient(Geometry=rotate_4.Geometry, Source=bounding_rectangle_2.Bounding, Target=rectangle_6.Rectangle)  # -> Geometry, Transform
unit_z_4 = UnitZ(Factor=Slider(0.01, range=0..0.01))
move_10 = Move(Geometry=[orient.Geometry, orient_2.Geometry], Motion=unit_z_4)  # -> Geometry, Transform
construct_mesh_13 = ConstructMesh(Vertices=deconstruct_mesh_8.Vertices, Faces=deconstruct_mesh_8.Faces, Colours="0,0,0")
construct_mesh_14 = ConstructMesh(Vertices=deconstruct_mesh_9.Vertices, Faces=deconstruct_mesh_9.Faces, Colours="0,0,0")
merge_5 = Merge(Data1=move_10.Geometry, Data2=construct_mesh_13, Data3=construct_mesh_14)
xz_plane_2 = XZPlane(Origin=Point(0, 0, 0))
yz_plane_2 = YZPlane(Origin=Point(0, 0, 0))
# Visualize
rotate_5 = Rotate(Geometry=merge_5, Angle=1.570796327, Plane=yz_plane_2)  # -> Geometry, Transform

data_5 = Data(partition_list)
panel_28 = Panel("1")  # disabled
panel_29 = Panel("2")  # disabled
panel_30 = Panel("3")  # disabled
panel_31 = Panel("5")  # disabled
list_item_21 = ListItem(List=data_5, Index=0, Wrap=True)  # disabled
list_item_22 = ListItem(List=data_5, Index=panel_28, Wrap=True)  # disabled
list_item_23 = ListItem(List=data_5, Index=panel_29, Wrap=True)  # disabled
list_item_24 = ListItem(List=data_5, Index=panel_30, Wrap=True)  # disabled
list_item_25 = ListItem(List=data_5, Index=panel_31, Wrap=True)  # disabled
number_slider_18 = Slider(100, range=0..100)  # disabled
number_slider_19 = Slider(0.5, range=0..1)  # disabled
list_item_26 = ListItem(List=flatten(list_item_21), Index=number_slider_18, Wrap=True)  # disabled
list_item_27 = ListItem(List=flatten(list_item_23), Index=number_slider_18, Wrap=True)  # disabled
list_item_28 = ListItem(List=flatten(list_item_22), Index=number_slider_18, Wrap=True)  # disabled
list_item_29 = ListItem(List=flatten(list_item_24), Index=number_slider_18, Wrap=True)  # disabled
list_item_30 = ListItem(List=flatten(list_item_25), Index=number_slider_18, Wrap=True)  # disabled
scale_5 = Scale(Geometry=list_item_26, Center=Point(0, 0, 0), Factor=number_slider_19)  # -> Geometry, Transform; disabled
yz_plane_3 = YZPlane(Origin=Point(0, 0, 0))  # disabled
rotate_6 = Rotate(Geometry=list_item_28, Angle=1.570796327, Plane=yz_plane_3)  # -> Geometry, Transform; disabled
panel_32 = Panel("-4")  # disabled
center_5 = Center(Geometry=scale_5.Geometry)  # -> Center, Dimension; disabled
unit_x_3 = UnitX(Factor=panel_32)  # disabled
panel_33 = Panel("-4")  # disabled
panel_34 = Panel("4")  # disabled
bounding_rectangle_4 = BoundingRectangle(Geometry=list_item_28, Plane=PlaneXY(0, 0, 0), Axis=0, Slide=0, Union=True)  # -> Bounding, DimensionX, DimensionY; disabled
panel_35 = Panel("256")  # disabled
dom_7 = ConstructDomain(DomainStart=panel_33, DomainEnd=panel_34)  # disabled
move_11 = Move(Geometry=list_item_28, Motion=unit_x_3)  # -> Geometry, Transform; disabled
move_to_point_5 = MoveToPoint(Geometry=scale_5.Geometry, PointA=center_5.Center)  # -> Moved, Vector, Transform; disabled
rectangle_7 = Rectangle(Plane=PlaneXY(0, 0, 0), XSize=dom_7, YSize=dom_7, Radius=0)  # -> Rectangle, Length; disabled
rotate_axis_2 = RotateAxis(Geometry=move_to_point_5.Moved, Angle=1.570796327, Axis=Line((0, 0, 0), (10, 0, 0)))  # -> Geometry, Transform; disabled
panel_36 = Panel("8")  # disabled
unit_x_4 = UnitX(Factor=panel_36)  # disabled
mesh_4 = Mesh(flatten([move_11.Geometry, rotate_axis_2.Geometry]))  # disabled
mesh_plane_6 = MeshPlane(Boundary=rectangle_7.Rectangle, WidthCount=panel_35, HeightCount=panel_35)  # -> Mesh, Area; disabled
move_12 = Move(Geometry=mesh_plane_6.Mesh, Motion=unit_x_4)  # -> Geometry, Transform; disabled
move_13 = Move(Geometry=rectangle_7.Rectangle, Motion=unit_x_4)  # -> Geometry, Transform; disabled
bounding_rectangle_5 = BoundingRectangle(Geometry=scale_5.Geometry, Plane=PlaneXY(0, 0, 0), Axis=0, Slide=0, Union=True)  # -> Bounding, DimensionX, DimensionY; disabled
deconstruct_mesh_10 = DeconstructMesh(Mesh=move_12.Geometry)  # -> Vertices, Faces, Colours, Normals; disabled
deconstruct_mesh_11 = DeconstructMesh(Mesh=mesh_plane_6.Mesh)  # -> Vertices, Faces, Colours, Normals; disabled
orient_3 = Orient(Geometry=scale_5.Geometry, Source=bounding_rectangle_5.Bounding, Target=move_13.Geometry)  # -> Geometry, Transform; disabled
orient_4 = Orient(Geometry=rotate_6.Geometry, Source=bounding_rectangle_4.Bounding, Target=rectangle_7.Rectangle)  # -> Geometry, Transform; disabled
panel_37 = Panel("0,0,0")  # disabled
panel_38 = Panel("0,0,0")  # disabled
number_slider_20 = Slider(0.01, range=0..0.01)  # disabled
unit_z_5 = UnitZ(Factor=number_slider_20)  # disabled
move_14 = Move(Geometry=[orient_3.Geometry, orient_4.Geometry], Motion=unit_z_5)  # -> Geometry, Transform; disabled
construct_mesh_15 = ConstructMesh(Vertices=deconstruct_mesh_10.Vertices, Faces=deconstruct_mesh_10.Faces, Colours=panel_38)  # disabled
construct_mesh_16 = ConstructMesh(Vertices=deconstruct_mesh_11.Vertices, Faces=deconstruct_mesh_11.Faces, Colours=panel_37)  # disabled
merge_6 = Merge(Data1=move_14.Geometry, Data2=construct_mesh_15, Data3=construct_mesh_16)  # disabled
xz_plane_3 = XZPlane(Origin=Point(0, 0, 0))  # disabled
yz_plane_4 = YZPlane(Origin=Point(0, 0, 0))  # disabled
rotate_7 = Rotate(Geometry=merge_6, Angle=1.570796327, Plane=yz_plane_4)  # -> Geometry, Transform; disabled

# ----
# Selection of optimized ones
construct_domain = ConstructDomain(DomainStart="23.00", DomainEnd="27.00")
deconstruct_domain_2 = DeconstructDomain()  # -> Start, End
panel_39 = Panel("37")
panel_40 = Panel("39")
construct_domain_2 = ConstructDomain(DomainStart="23", DomainEnd="34")
includes = Includes(Value=deconstruct_domain_2.Start, Domain=construct_domain)  # -> Includes, Deviation
includes_2 = Includes(Value=deconstruct_domain_2.End, Domain=construct_domain_2)  # -> Includes, Deviation
gate_and_2 = GateAnd(A=includes.Includes, B=includes_2.Includes)
cull_pattern_14 = CullPattern(List=explode_tree.Branch1, CullPattern=gate_and_2)
panel_41 = Panel(gate_and_2)
list_item_31 = ListItem(List=cull_pattern_14, Index=Slider(0, range=0..2), Wrap=True)

concatenate_6 = Concatenate(FragmentA=panel_41)

# ==== cluster EncodedImageV1
back_surface_of_room = ClusterInput()
mjoin = MeshJoin(Meshes=back_surface_of_room)
mesh = ClusterInput()
mesh_2 = Mesh(back_surface_of_room)
mesh_3 = Mesh(mesh)
center = Center(Geometry=mjoin, forall=False)  # -> Center, Dimension
center_2 = Center(Geometry=mesh, forall=False)  # -> Center, Dimension
deconstruct_mesh = DeconstructMesh(Mesh=mesh)  # -> Vertices, Faces, Colours, Normals

# ----
# Vector for Projection
vector_2pt = Vector2Pt(PointA=center_2.Center, PointB=center.Center, Unitize=False)  # -> Vector, Length

# ----
# Points
project_point = ProjectPoint(Point=deconstruct_mesh.Vertices, Direction=vector_2pt.Vector, Geometry=back_surface_of_room)  # -> Point, Index
deconstruct = Deconstruct(Point=project_point.Point)  # -> XComponent, YComponent, ZComponent

vdis = VectorDisplay(Anchor=center_2.Center, Vector=vector_2pt.Vector)
absolute = Absolute(Value=deconstruct.YComponent)
control_wire_display = ControlWireDisplay(WireDisplay="1")

# ----
# Point domain in Y
bounds = Bounds(Numbers=absolute)
deconstruct_domain = DeconstructDomain(Domain=bounds)  # -> Start, End

channel = ClusterInput()

# ----
# Checks if flat
subtraction = Subtraction(A=deconstruct_domain.Start, B=deconstruct_domain.End)
equality_within_tolerance = EqualityWithinTolerance(FirstNumber=subtraction, SecondNumber="0,00", Tolerance=0.01)  # -> Equality, Inequality

# ----
# Condition:
# Geometry of Surface
condition_flat = Panel("0")
condition_not_flat = Data(deconstruct_domain.End)
stream_filter = StreamFilter(Gate=equality_within_tolerance.Equality, Stream0=condition_not_flat, Stream1=condition_flat)

construct_domain = ConstructDomain(DomainStart=deconstruct_domain.Start, DomainEnd=stream_filter)

# ----
# Red Channel
panel = Panel("0")
equality = Equality(FirstNumber=channel, SecondNumber=panel)  # -> Equality, Inequality
stream_filter_2 = StreamFilter(Gate=equality.Equality, Stream0="0 to 0", Stream1="255 to 30")
remap_numbers = RemapNumbers(Value=absolute, Source=construct_domain, Target=stream_filter_2)  # -> Mapped, Clipped

# ----
# Blue Channel
panel_2 = Panel("2")
equality_2 = Equality(FirstNumber=channel, SecondNumber=panel_2)  # -> Equality, Inequality
stream_filter_3 = StreamFilter(Gate=equality_2.Equality, Stream0="0 to 0", Stream1="255 to 30")
remap_numbers_2 = RemapNumbers(Value=absolute, Source=construct_domain, Target=stream_filter_3)  # -> Mapped, Clipped

# ----
# Green Channel
panel_3 = Panel("1")
equality_3 = Equality(FirstNumber=channel, SecondNumber=panel_3)  # -> Equality, Inequality
stream_filter_4 = StreamFilter(Gate=equality_3.Equality, Stream0="0 to 0", Stream1="60 to 255")
remap_numbers_3 = RemapNumbers(Value=absolute, Source=construct_domain, Target=stream_filter_4)  # -> Mapped, Clipped

colour_rgb = ColourRGB(Alpha=255, Red=remap_numbers.Mapped, Green=remap_numbers_3.Mapped, Blue=remap_numbers_2.Mapped)

# ----
# Replace <null> cells
# with 0,0,1 (black)
null_item = NullItem(Item=colour_rgb)  # -> NullFlags, InvalidFlags, Description
list_length = ListLength(List=colour_rgb)
series = Series(Start=0, Step=1, Count=list_length)
cull_pattern = CullPattern(List=series, CullPattern=null_item.InvalidFlags)

replace_items = ReplaceItems(List=remap_numbers_2.Mapped, Item="1", Indices=cull_pattern, Wrap=False)
replace_items_2 = ReplaceItems(List=remap_numbers.Mapped, Item="1", Indices=cull_pattern, Wrap=False)
replace_items_3 = ReplaceItems(List=remap_numbers_3.Mapped, Item="1", Indices=cull_pattern, Wrap=False)
list_of_red_values = ClusterOutput(replace_items_2)
list_of_blue_values = ClusterOutput(replace_items)
list_of_green_values = ClusterOutput(replace_items_3)
b_channel = Panel("0,0,1")
r_channel = Panel("1,0,0")
g_channel = Panel("0,1,0")
stream_filter_5 = StreamFilter(Gate=channel, Stream0=r_channel, Stream1=g_channel, Stream2=b_channel)

# ----
# Create List colors
replace_items_4 = ReplaceItems(List=colour_rgb, Item=stream_filter_5, Indices=cull_pattern, Wrap=False)

panel_4 = Panel(replace_items_4)

# ----
# Output Gradient
construct_mesh = ConstructMesh(Vertices=deconstruct_mesh.Vertices, Faces=deconstruct_mesh.Faces, Colours=replace_items_4)

output_b_channel = ClusterOutput(construct_mesh)

# ==== cluster EncodedImageV2
mesh_image = ClusterInput()
geomtery_to_encode = ClusterInput()
skin_typology_resolution = ClusterInput()
channel = ClusterInput()
direction_projection = ClusterInput()
control_wire_display = ControlWireDisplay(WireDisplay="1")
number_slider = Slider(9, range=0..10)
mesh_surface = MeshSurface(
    Surface=geomtery_to_encode,
    UCount=Slider(256, range=0..256),
    VCount=skin_typology_resolution,
    Overhang=True,
    Equalize=False)
deconstruct_mesh = DeconstructMesh(Mesh=mesh_image)  # -> Vertices, Faces, Colours, Normals
mesh_join = MeshJoin(Meshes=mesh_surface)

deconstruct_mesh_2 = DeconstructMesh(Mesh=mesh_join)  # -> Vertices, Faces, Colours, Normals
deconstruct = Deconstruct(Point=deconstruct_mesh_2.Vertices)  # -> XComponent, YComponent, ZComponent
construct_point = ConstructPoint(XCoordinate=deconstruct.XComponent, YCoordinate="-5", ZCoordinate=deconstruct.ZComponent)

# ----
# Points
mesh_ray = MeshRay(Mesh=mesh_join, Point=deconstruct_mesh.Vertices, Direction=expr("-x", direction_projection))  # -> Point, Hit; disabled

list_length = ListLength(List=deconstruct_mesh.Vertices)
create_rtree = CreateRTree(InputGeometry=flatten(deconstruct_mesh.Vertices))
series = Series(Start=0, Step="0", Count=list_length)
rtree_closest_point = RTreeClosestPoint(SearchPoints=flatten(construct_point), RTree=create_rtree)  # -> ClosestPoint, ClosestIndex
replace_items = ReplaceItems(List=series, Item=deconstruct.YComponent, Indices=rtree_closest_point.ClosestIndex, Wrap=False)

absolute = Absolute(Value=replace_items)
create_set = CreateSet(List=absolute)  # -> Set, Map
equality = Equality(FirstNumber=absolute, SecondNumber=Slider(0, range=0..100))  # -> Equality, Inequality
cull_pattern = CullPattern(List=absolute, CullPattern=equality.Inequality)
# Point domain in Y
bounds = Bounds(Numbers=cull_pattern)
deconstruct_domain = DeconstructDomain(Domain=bounds)  # -> Start, End
# Checks if flat
subtraction = Subtraction(A=deconstruct_domain.Start, B=deconstruct_domain.End)
# Red Channel
panel = Panel("0")
condition_flat = Panel("0")
# Condition:
# Geometry of Surface
condition_not_flat = Data(deconstruct_domain.End)
# Blue Channel
panel_2 = Panel("2")
# Green Channel
panel_3 = Panel("1")
equality_within_tolerance = EqualityWithinTolerance(FirstNumber=subtraction, SecondNumber="0,00", Tolerance=0.01)  # -> Equality, Inequality
equality_2 = Equality(FirstNumber=channel, SecondNumber=panel_3)  # -> Equality, Inequality
equality_3 = Equality(FirstNumber=channel, SecondNumber=panel)  # -> Equality, Inequality
equality_4 = Equality(FirstNumber=channel, SecondNumber=panel_2)  # -> Equality, Inequality
stream_filter = StreamFilter(Gate=equality_within_tolerance.Equality, Stream0=condition_not_flat, Stream1=condition_flat)
construct_domain = ConstructDomain(DomainStart=deconstruct_domain.Start, DomainEnd=stream_filter)
stream_filter_2 = StreamFilter(Gate=equality_2.Equality, Stream0="0 to 0", Stream1="1 to 255")
stream_filter_3 = StreamFilter(Gate=equality_4.Equality, Stream0="0 to 0", Stream1="255 to 30")
stream_filter_4 = StreamFilter(Gate=equality_3.Equality, Stream0="0 to 0", Stream1="255 to 30")
remap_numbers = RemapNumbers(Value=absolute, Source=construct_domain, Target=stream_filter_4)  # -> Mapped, Clipped
remap_numbers_2 = RemapNumbers(Value=absolute, Source=construct_domain, Target=stream_filter_3)  # -> Mapped, Clipped
remap_numbers_3 = RemapNumbers(Value=absolute, Source=construct_domain, Target=stream_filter_2)  # -> Mapped, Clipped
colour_rgb = ColourRGB(Alpha=255, Red=remap_numbers.Mapped, Green=remap_numbers_3.Mapped, Blue=remap_numbers_2.Mapped)
null_item = NullItem(Item=colour_rgb)  # -> NullFlags, InvalidFlags, Description
# Replace <null> cells
# with 0,0,1 (black)
list_length_2 = ListLength(List=colour_rgb)
series_2 = Series(Start=0, Step=1, Count=list_length_2)
cull_pattern_2 = CullPattern(List=series_2, CullPattern=null_item.InvalidFlags)
replace_items_2 = ReplaceItems(List=remap_numbers_2.Mapped, Item="1", Indices=cull_pattern_2, Wrap=False)
replace_items_3 = ReplaceItems(List=remap_numbers_3.Mapped, Item="1", Indices=cull_pattern_2, Wrap=False)
replace_items_4 = ReplaceItems(List=remap_numbers.Mapped, Item="1", Indices=cull_pattern_2, Wrap=False)
blue_values = ClusterOutput(replace_items_2)
red_values = ClusterOutput(replace_items_4)
green_values = ClusterOutput(replace_items_3)
b_channel = Panel("0,0,1")
r_channel = Panel("1,0,0")
g_channel = Panel("0,1,0")
stream_filter_5 = StreamFilter(Gate=channel, Stream0=r_channel, Stream1=g_channel, Stream2=b_channel)
# Create List colors
replace_items_5 = ReplaceItems(List=colour_rgb, Item=stream_filter_5, Indices=cull_pattern_2, Wrap=False)
# Output Gradient
construct_mesh = ConstructMesh(Vertices=deconstruct_mesh.Vertices, Faces=deconstruct_mesh.Faces, Colours=replace_items_5)
panel_4 = Panel(replace_items_5)
colored_mesh = ClusterOutput(construct_mesh)

# ==== cluster EncodedImageV4
red_channel_precision = ClusterInput()  # Multiply the U count
mersh_vectors = ClusterInput()
dist_facade_skin = ClusterInput()
facade_window_srf = ClusterInput()
skin_typology_srf = ClusterInput()
g_color_domain = ClusterInput()
back_room_wall_srf = ClusterInput()
b_color_domain = ClusterInput()
u_count = ClusterInput()
r_color_domain = ClusterInput()
max_room_distance = ClusterInput()
v_count = ClusterInput()
facade_surface = ClusterInput()
data = Data(dist_facade_skin)
list_length = ListLength(List=flatten(skin_typology_srf))
multiplication = Multiplication(A=u_count, B=red_channel_precision)
multiplication_2 = Multiplication(A=u_count, B=red_channel_precision)
division = Division(A=u_count, B=list_length)

mesh_surface = MeshSurface(Surface=facade_surface, UCount=multiplication, VCount=v_count, Overhang=True, Equalize=False)
mesh_join = MeshJoin(Meshes=mesh_surface)
deconstruct_mesh = DeconstructMesh(Mesh=mesh_join)  # -> Vertices, Faces, Colours, Normals

mesh_surface_2 = MeshSurface(Surface=flatten(skin_typology_srf), UCount=division, VCount=v_count, Overhang=True, Equalize=False)
mesh_join_2 = MeshJoin(Meshes=mesh_surface_2)
deconstruct_mesh_2 = DeconstructMesh(Mesh=mesh_join_2)  # -> Vertices, Faces, Colours, Normals

mesh_surface_3 = MeshSurface(Surface=flatten(skin_typology_srf), UCount=v_count, VCount=u_count, Overhang=True, Equalize=False)
mesh_join_3 = MeshJoin(Meshes=mesh_surface_3)
deconstruct_mesh_3 = DeconstructMesh(Mesh=mesh_join_3)  # -> Vertices, Faces, Colours, Normals

# ----
# List Generation
list_length_2 = ListLength(List=mersh_vectors)
duplicate_data = DuplicateData(Data="0,0,0", Number=list_length_2, Order=True)
duplicate_data_2 = DuplicateData(Data="0", Number=list_length_2, Order=True)

data_2 = Data(skin_typology_srf)
curve = Curve(data_2)

point_in_curves = PointInCurves(Point=deconstruct_mesh.Vertices, Curves=facade_window_srf)  # -> Relationship, Index, Point
cull_pattern = CullPattern(List=deconstruct_mesh.Vertices, CullPattern=point_in_curves.Relationship)

geometry = Geometry(facade_surface)
evaluate_surface = EvaluateSurface(Surface=geometry, Point="0.5,0.5")  # -> Point, Normal, UDirection, VDirection, Frame
project_along = ProjectAlong(Geometry=cull_pattern, Plane=geometry, Direction=evaluate_surface.Normal)  # -> Geometry, Transform

line = Line(StartPoint=cull_pattern, EndPoint=project_along.Geometry)
length = Length(Curve=line)

python_3_script = Python3Script(x=length)  # -> out; inputs x: list
# ---------- python_3_script: Python ----------
max_x=round(max(x))

if max_x == 0.0:
    y=1
    print(y)
else:
    print(max_x)
# ---------- end python_3_script ----------
list_length_3 = ListLength(List=length)
larger_than = LargerThan(FirstNumber=length, SecondNumber=python_3_script)  # -> LargerThan, OrEqualTo
series = Series(Start=0, Step=1, Count=list_length_3)
cull_pattern_2 = CullPattern(List=series, CullPattern=larger_than.LargerThan)
construct_domain = ConstructDomain(DomainStart="0", DomainEnd=python_3_script)
replace_items = ReplaceItems(List=length, Item=python_3_script, Indices=cull_pattern_2, Wrap=False)

panel = Panel(python_3_script)
panel_2 = Panel(series)
control_wire_display = ControlWireDisplay(WireDisplay="1")

remap_numbers = RemapNumbers(Value=replace_items, Source=construct_domain, Target=r_color_domain)  # -> Mapped, Clipped
round = Round(Number=remap_numbers.Mapped)  # -> Nearest, Floor, Ceiling
create_rtree = CreateRTree(InputGeometry=flatten(mersh_vectors))
rtree_closest_point = RTreeClosestPoint(SearchPoints=flatten(project_along.Geometry), RTree=create_rtree)  # -> ClosestPoint, ClosestIndex
concatenate = Concatenate(FragmentB=round.Nearest, FragmentA="0,0", JoinSeparator=",")

# ----
# R channel Image
replace_items_2 = ReplaceItems(List=duplicate_data, Item=concatenate, Indices=rtree_closest_point.ClosestIndex, Wrap=False)

# ----
# Only R values
replace_items_3 = ReplaceItems(List=duplicate_data_2, Item=round.Nearest, Indices=rtree_closest_point.ClosestIndex, Wrap=False)

# ----
# Red Channel
r_channel_values = ClusterOutput(replace_items_3)
r_channel_image = ClusterOutput(replace_items_2)

shaders_faces = ClusterOutput(deconstruct_mesh_3.Faces)

# ----
# Blue Channel
mesh_surface_4 = MeshSurface(Surface=facade_surface, UCount=multiplication_2, VCount=v_count, Overhang=True, Equalize=False)
mesh_surface_5 = MeshSurface(Surface=back_room_wall_srf, UCount=u_count, VCount=v_count, Overhang=True, Equalize=False)
deconstruct_mesh_4 = DeconstructMesh(Mesh=mesh_surface_4)  # -> Vertices, Faces, Colours, Normals

deconstruct_mesh_5 = DeconstructMesh(Mesh=mesh_surface_5)  # -> Vertices, Faces, Colours, Normals
partition_list = PartitionList(List=reverse(deconstruct_mesh_5.Vertices), Size=expr("x+1", v_count))  # -> simplify(Chunks)
deconstruct = Deconstruct(Point=partition_list)  # -> XComponent, YComponent, ZComponent
sort_list = SortList(Keys=deconstruct.ZComponent, ValuesValuesA=partition_list)  # -> Keys, simplify(flatten(ValuesValuesA))

line_2 = Line(StartPoint=deconstruct_mesh_4.Vertices, EndPoint=sort_list.ValuesValuesA)
length_2 = Length(Curve=line_2)

# ---- group: Test if bigger than max room size
list_length_4 = ListLength(List=length_2)
larger_than_2 = LargerThan(FirstNumber=length_2, SecondNumber=max_room_distance)  # -> LargerThan, OrEqualTo
series_2 = Series(Start=0, Step=1, Count=list_length_4)
cull_pattern_3 = CullPattern(List=series_2, CullPattern=larger_than_2.LargerThan)
replace_items_4 = ReplaceItems(List=length_2, Item=max_room_distance, Indices=cull_pattern_3, Wrap=False)

# ----
geometry_2 = Geometry(facade_surface)
evaluate_surface_2 = EvaluateSurface(Surface=geometry_2, Point="0.5,0.5")  # -> Point, Normal, UDirection, VDirection, Frame

project_along_2 = ProjectAlong(Geometry=data_2, Plane=geometry_2, Direction=evaluate_surface_2.Normal)  # -> Geometry, Transform
brep_wireframe = BrepWireframe(Brep=project_along_2.Geometry, Density=-1)
point_in_curves_2 = PointInCurves(Point=deconstruct_mesh_2.Vertices, Curves=flatten(brep_wireframe))  # -> Relationship, Index, Point
cull_pattern_4 = CullPattern(List=deconstruct_mesh_2.Vertices, CullPattern=invert(point_in_curves_2.Relationship))

project_along_3 = ProjectAlong(Geometry=cull_pattern_4, Plane=geometry_2, Direction=evaluate_surface_2.Normal)  # -> Geometry, Transform

line_3 = Line(StartPoint=cull_pattern_4, EndPoint=project_along_3.Geometry)
length_3 = Length(Curve=line_3)
python_3_script_2 = Python3Script(x=length_3)  # -> out; inputs x: list
# ---------- python_3_script_2: Python ----------
max_x=max(x)

if max_x == 0:
    y=1
    print(y)
else:
    print(max_x)
# ---------- end python_3_script_2 ----------
list_length_5 = ListLength(List=length_3)
larger_than_3 = LargerThan(FirstNumber=length_3, SecondNumber=python_3_script_2)  # -> LargerThan, OrEqualTo
series_3 = Series(Start=0, Step=1, Count=list_length_5)
cull_pattern_5 = CullPattern(List=series_3, CullPattern=larger_than_3.LargerThan)
construct_domain_2 = ConstructDomain(DomainStart="0", DomainEnd=python_3_script_2)
replace_items_5 = ReplaceItems(List=length_3, Item=python_3_script_2, Indices=cull_pattern_5, Wrap=False)

remap_numbers_2 = RemapNumbers(Value=replace_items_5, Source=construct_domain_2, Target=g_color_domain)  # -> Mapped, Clipped
create_rtree_2 = CreateRTree(InputGeometry=flatten(mersh_vectors))
round_2 = Round(Number=remap_numbers_2.Mapped)  # -> Nearest, Floor, Ceiling
rtree_closest_point_2 = RTreeClosestPoint(SearchPoints=flatten(project_along_3.Geometry), RTree=create_rtree_2)  # -> ClosestPoint, ClosestIndex
concatenate_2 = Concatenate(Fragment_B="0", A=round_2.Nearest, B="0", JoinSeparator=",")

# ----
# G channel Image
replace_items_6 = ReplaceItems(List=duplicate_data, Item=concatenate_2, Indices=rtree_closest_point_2.ClosestIndex, Wrap=False)

# ----
# Only G values
replace_items_7 = ReplaceItems(List=duplicate_data_2, Indices=rtree_closest_point_2.ClosestIndex, Wrap=False)

# ----
# Green Channel
g_channel_image = ClusterOutput(replace_items_6)
g_channel_values = ClusterOutput(replace_items_7)

construct_domain_3 = ConstructDomain(DomainStart="0", DomainEnd=max_room_distance)
create_rtree_3 = CreateRTree(InputGeometry=flatten(mersh_vectors))
remap_numbers_3 = RemapNumbers(Value=replace_items_4, Source=construct_domain_3, Target=b_color_domain)  # -> Mapped, Clipped
rtree_closest_point_3 = RTreeClosestPoint(SearchPoints=flatten(deconstruct_mesh_4.Vertices), RTree=create_rtree_3)  # -> ClosestPoint, ClosestIndex

round_3 = Round(Number=remap_numbers_3.Mapped)  # -> Nearest, Floor, Ceiling

concatenate_3 = Concatenate(FragmentB="0,0", FragmentA=round_3.Nearest, JoinSeparator=",")

# ----
# B channel Image
replace_items_8 = ReplaceItems(List=duplicate_data, Item=concatenate_3, Indices=rtree_closest_point_3.ClosestIndex, Wrap=False)

# ----
# Only B values
replace_items_9 = ReplaceItems(List=duplicate_data_2, Item=round_3.Nearest, Indices=rtree_closest_point_3.ClosestIndex, Wrap=False)

b_channel_values = ClusterOutput(replace_items_9)
b_channel_image = ClusterOutput(replace_items_8)

panel_3 = Panel(replace_items_8)
concatenate_4 = Concatenate(R=replace_items_3, G=replace_items_7, B=replace_items_9, JoinSeparator=",")
encoded_image = ClusterOutput(concatenate_4)

# ==== cluster EncodedImageV3
mersh_vectors = ClusterInput()
dist_facade_skin = ClusterInput()
max_heigth_room_z = ClusterInput()
max_width_x = ClusterInput()

# ----
# Filter Points
deconstruct = Deconstruct(Point=mersh_vectors)  # -> XComponent, YComponent, ZComponent
smaller_than = SmallerThan(FirstNumber=deconstruct.YComponent, SecondNumber=max_width_x)  # -> SmallerThan, OrEqualTo
larger_than = LargerThan(FirstNumber=deconstruct.ZComponent, SecondNumber="0")  # -> LargerThan, OrEqualTo
smaller_than_2 = SmallerThan(FirstNumber=deconstruct.ZComponent, SecondNumber=max_heigth_room_z)  # -> SmallerThan, OrEqualTo
larger_than_2 = LargerThan(FirstNumber=deconstruct.YComponent, SecondNumber="0")  # -> LargerThan, OrEqualTo
gate_and = GateAnd(A=larger_than.OrEqualTo, B=smaller_than_2.OrEqualTo, C=larger_than_2.OrEqualTo, D=smaller_than.OrEqualTo)
cull_pattern = CullPattern(List=mersh_vectors, CullPattern=gate_and)

facade_window_srf = ClusterInput()
r_color_domain = ClusterInput()
skin_typology_srf = ClusterInput()
g_color_domain = ClusterInput()
back_room_wall_srf = ClusterInput()
b_color_domain = ClusterInput()

deconstruct_2 = Deconstruct(Point=cull_pattern)  # -> XComponent, YComponent, ZComponent
equality = Equality(FirstNumber=deconstruct_2.ZComponent, SecondNumber="0")  # -> Equality, Inequality
cull_pattern_2 = CullPattern(List=cull_pattern, CullPattern=equality.Equality)
list_length = ListLength(List=cull_pattern_2)

deconstruct_3 = Deconstruct(Point=cull_pattern)  # -> XComponent, YComponent, ZComponent
equality_2 = Equality(FirstNumber=deconstruct_3.YComponent, SecondNumber="0")  # -> Equality, Inequality
cull_pattern_3 = CullPattern(List=cull_pattern, CullPattern=equality_2.Equality)
list_length_2 = ListLength(List=cull_pattern_3)

data = Data(dist_facade_skin)

mesh_surface = MeshSurface(Surface=back_room_wall_srf, UCount=list_length, VCount=list_length_2, Overhang=True, Equalize=False)
mesh_join = MeshJoin(Meshes=mesh_surface)
deconstruct_mesh = DeconstructMesh(Mesh=mesh_join)  # -> Vertices, Faces, Colours, Normals
deconstruct_4 = Deconstruct(Point=deconstruct_mesh.Vertices)  # -> XComponent, YComponent, ZComponent
round = Round(Number=deconstruct_4.YComponent)  # -> Nearest, Floor, Ceiling
construct_point = ConstructPoint(XCoordinate=deconstruct_4.XComponent, YCoordinate=data, ZCoordinate=deconstruct_4.ZComponent)
bounds = Bounds(Numbers=round.Nearest)

# ----
# List Generation
list_length_3 = ListLength(List=mersh_vectors)
duplicate_data = DuplicateData(Data="0,0,0", Number=list_length_3, Order=True)
duplicate_data_2 = DuplicateData(Data="0", Number=list_length_3, Order=True)

control_wire_display = ControlWireDisplay(WireDisplay="1")

mesh_surface_2 = MeshSurface(Surface=flatten(skin_typology_srf), UCount=list_length_2, VCount=list_length, Overhang=True, Equalize=False)
mesh_join_2 = MeshJoin(Meshes=mesh_surface_2)
deconstruct_mesh_2 = DeconstructMesh(Mesh=mesh_join_2)  # -> Vertices, Faces, Colours, Normals

deconstruct_5 = Deconstruct(Point=deconstruct_mesh_2.Vertices)  # -> XComponent, YComponent, ZComponent

round_2 = Round(Number=deconstruct_5.XComponent)  # -> Nearest, Floor, Ceiling
bounds_2 = Bounds(Numbers=deconstruct_5.XComponent)

panel = Panel(deconstruct_5.XComponent)
construct_point_2 = ConstructPoint(XCoordinate=data, YCoordinate=deconstruct_5.YComponent, ZCoordinate=deconstruct_5.ZComponent)
panel_2 = Panel(round_2.Nearest)
faces = ClusterOutput(deconstruct_mesh_2.Faces)

mesh_surface_3 = MeshSurface(Surface=facade_window_srf, UCount=list_length, VCount=list_length_2, Overhang=True, Equalize=False)
mesh_join_3 = MeshJoin(Meshes=mesh_surface_3)
deconstruct_mesh_3 = DeconstructMesh(Mesh=mesh_join_3)  # -> Vertices, Faces, Colours, Normals
deconstruct_6 = Deconstruct(Point=deconstruct_mesh_3.Vertices)  # -> XComponent, YComponent, ZComponent
construct_point_3 = ConstructPoint(XCoordinate=0, YCoordinate=0, ZCoordinate=0)

deconstruct_7 = Deconstruct(Point=deconstruct_mesh_3.Vertices)  # -> XComponent, YComponent, ZComponent

round_3 = Round(Number=deconstruct_7.XComponent)  # -> Nearest, Floor, Ceiling
bounds_3 = Bounds(Numbers=round_3.Nearest)

construct_point_4 = ConstructPoint(XCoordinate=data, YCoordinate=deconstruct_7.YComponent, ZCoordinate=deconstruct_7.ZComponent)

remap_numbers = RemapNumbers(Value=deconstruct_4.YComponent, Source=bounds, Target=b_color_domain)  # -> Mapped, Clipped
create_rtree = CreateRTree(InputGeometry=flatten(mersh_vectors))
rtree_closest_point = RTreeClosestPoint(SearchPoints=flatten(construct_point), RTree=create_rtree)  # -> ClosestPoint, ClosestIndex

round_4 = Round(Number=remap_numbers.Mapped)  # -> Nearest, Floor, Ceiling

concatenate = Concatenate(FragmentB="0,0", FragmentA=round_4.Nearest, JoinSeparator=",")

# ----
# B channel Image
replace_items = ReplaceItems(List=duplicate_data, Item=concatenate, Indices=rtree_closest_point.ClosestIndex, Wrap=False)

# ----
# Only B values
replace_items_2 = ReplaceItems(List=duplicate_data_2, Item=round_4.Nearest, Indices=rtree_closest_point.ClosestIndex, Wrap=False)

# ----
# Blue Channel
b_channel_values = ClusterOutput(replace_items_2)
b_channel_image = ClusterOutput(replace_items)

remap_numbers_2 = RemapNumbers(Value=deconstruct_7.XComponent, Source=bounds_3, Target=r_color_domain)  # -> Mapped, Clipped
create_rtree_2 = CreateRTree(InputGeometry=flatten(mersh_vectors))
rtree_closest_point_2 = RTreeClosestPoint(SearchPoints=flatten(construct_point_4), RTree=create_rtree_2)  # -> ClosestPoint, ClosestIndex

round_5 = Round(Number=remap_numbers_2.Mapped)  # -> Nearest, Floor, Ceiling

concatenate_2 = Concatenate(FragmentB=round_5.Nearest, FragmentA="0,0", JoinSeparator=",")

# ----
# R channel Image
replace_items_3 = ReplaceItems(List=duplicate_data, Item=concatenate_2, Indices=rtree_closest_point_2.ClosestIndex, Wrap=False)

# ----
# Only R values
replace_items_4 = ReplaceItems(List=duplicate_data_2, Item=round_5.Nearest, Indices=rtree_closest_point_2.ClosestIndex, Wrap=False)

# ----
# Red Channel
r_channel_values = ClusterOutput(replace_items_4)
r_channel_image = ClusterOutput(replace_items_3)

remap_numbers_3 = RemapNumbers(Value=deconstruct_5.XComponent, Source=bounds_2, Target=g_color_domain)  # -> Mapped, Clipped
create_rtree_3 = CreateRTree(InputGeometry=flatten(mersh_vectors))
rtree_closest_point_3 = RTreeClosestPoint(SearchPoints=flatten(construct_point_2), RTree=create_rtree_3)  # -> ClosestPoint, ClosestIndex

round_6 = Round(Number=remap_numbers_3.Mapped)  # -> Nearest, Floor, Ceiling

concatenate_3 = Concatenate(Fragment_B="0", A=round_6.Nearest, B="0", JoinSeparator=",")

# ----
# G channel Image
replace_items_5 = ReplaceItems(List=duplicate_data, Item=concatenate_3, Indices=rtree_closest_point_3.ClosestIndex, Wrap=False)

# ----
# Only G values
replace_items_6 = ReplaceItems(List=duplicate_data_2, Item=round_6.Nearest, Indices=rtree_closest_point_3.ClosestIndex, Wrap=False)

# ----
# Green Channel
g_channel_image = ClusterOutput(replace_items_5)
g_channel_values = ClusterOutput(replace_items_6)

concatenate_4 = Concatenate(R=replace_items_4, G=replace_items_6, B=replace_items_2, JoinSeparator=",")
encoded_image = ClusterOutput(concatenate_4)

# ==== cluster Cluster
geometry = ClusterInput()
rotate = Rotate(Geometry=geometry, Angle=1.570796327, Plane=PlaneXY(0, 0, 0))  # -> Geometry, Transform
area = Area(Geometry=rotate.Geometry)  # -> Area, Centroid
factor = ClusterInput()
scale = Scale(Geometry=rotate.Geometry, Center=area.Centroid, Factor=factor)  # -> Geometry, Transform
point_b = ClusterInput()
move_to_point = MoveToPoint(Geometry=scale.Geometry, PointA=area.Centroid, PointB=point_b)  # -> Moved, Vector, Transform
moved = ClusterOutput(move_to_point.Moved)

# ==== cluster Cluster_2
geometry = ClusterInput()
rotate = Rotate(Geometry=geometry, Angle=1.570796327, Plane=PlaneXY(0, 0, 0))  # -> Geometry, Transform
area = Area(Geometry=geometry)  # -> Area, Centroid
factor = ClusterInput()
scale = Scale(Geometry=geometry, Center=area.Centroid, Factor=factor)  # -> Geometry, Transform
point_b = ClusterInput()
move_to_point = MoveToPoint(Geometry=scale.Geometry, PointA=area.Centroid, PointB=point_b)  # -> Moved, Vector, Transform
moved = ClusterOutput(move_to_point.Moved)

# ==== cluster Skins
nbr_of_panels = ClusterInput()
surface = ClusterInput()
solid = ClusterInput()
angle = ClusterInput()
brep_edges = BrepEdges(Brep=surface)  # -> Naked, Interior, NonManifold
divide_surface = DivideSurface(Surface=surface, UCount=nbr_of_panels, VCount=10)  # -> Points, Normals, Parameters
curve_middle = CurveMiddle(Curve=brep_edges.Naked)
area = Area(Geometry=surface)  # -> Area, Centroid
interpolate = Interpolate(Vertices=divide_surface.Points, Degree=3, Periodic=False, KnotStyle=1)  # -> Curve, Length, Domain
deconstruct = Deconstruct(Point=curve_middle)  # -> XComponent, YComponent, ZComponent
division = Division(A=solid, B="100")
sort_list = SortList(Keys=deconstruct.ZComponent, ValuesValuesA=brep_edges.Naked)  # -> Keys, ValuesValuesA
sort_list_2 = SortList(Keys=deconstruct.ZComponent, ValuesValuesA=deconstruct.ZComponent)  # -> Keys, ValuesValuesA
cull_index = CullIndex(List=flatten(interpolate.Curve), Indices="-1", Wrap=True)  # -> simplify(graft(List))
panel = Panel("""-1
0""")
multiplication = Multiplication(A=area.Area, B=division)
list_item = ListItem(List=sort_list.ValuesValuesA, Index=0, Wrap=True)  # -> Item1, Item
cull_index_2 = CullIndex(List=sort_list_2.ValuesValuesA, Indices=panel, Wrap=True)
length = Length(Curve=list_item.Item)
division_2 = Division(A=length, B=nbr_of_panels)
construct_domain = ConstructDomain(DomainStart=0, DomainEnd=expr("x/2", division_2))
division_3 = Division(A=multiplication, B=nbr_of_panels)
list_item_2 = ListItem(List=cull_index_2, Index=0, Wrap=True)
panel_2 = Panel(multiplication)
end_points = EndPoints(Curve=cull_index)  # -> Start, End
division_4 = Division(A=division_3, B=list_item_2)
division_5 = Division(A=division_4, B="2")
trim_tree = TrimTree(Tree=division_5, Depth=1)
offset_curve = OffsetCurve(Curve=cull_index, Distance=graft(trim_tree), Plane=surface, Corners=1)  # -> simplify(Curve)
end_points_2 = EndPoints(Curve=offset_curve)  # -> Start, End
panel_3 = Panel(trim_tree)
line = Line(StartPoint=end_points.End, EndPoint=end_points_2.End)  # -> simplify(Line)
line_2 = Line(StartPoint=end_points_2.Start, EndPoint=end_points.Start)  # -> simplify(Line)
join_curves = JoinCurves(Curves=[line_2, line, offset_curve, cull_index], Preserve=False)  # -> simplify(Curves)
list_item_3 = ListItem(List=join_curves, Index=Slider(1, range=0..1), Wrap=True)  # -> simplify(Item)
close_curve = CloseCurve(Curve=list_item_3, CloseType=0, Bulge=0.5, Tolerance=0)  # -> Closed, ResultBoolean
boundary_surfaces = BoundarySurfaces(Edges=close_curve.Closed)
point_location = ClusterInput()
duplicate_data = DuplicateData(Data=angle, Number=2, Order=True)  # -> simplify(graft(Data))
evaluate_surface = EvaluateSurface(Surface=reparameterize(boundary_surfaces), Point=point_location)  # -> Point, Normal, UDirection, VDirection, Frame
rotate = Rotate(Geometry=boundary_surfaces, Angle=degrees(duplicate_data), Plane=evaluate_surface.Point)  # -> Geometry, Transform
geometry = ClusterOutput(rotate.Geometry)

# ==== cluster Cluster_3
max_heigth_room_z = ClusterInput()
mesh_vertices = ClusterInput()
max_width_x = ClusterInput()

# ----
# Filter Points
deconstruct = Deconstruct(Point=mesh_vertices)  # -> XComponent, YComponent, ZComponent
larger_than = LargerThan(FirstNumber=deconstruct.ZComponent, SecondNumber="0")  # -> LargerThan, OrEqualTo
smaller_than = SmallerThan(FirstNumber=deconstruct.ZComponent, SecondNumber=max_heigth_room_z)  # -> SmallerThan, OrEqualTo
larger_than_2 = LargerThan(FirstNumber=deconstruct.XComponent, SecondNumber="0")  # -> LargerThan, OrEqualTo
smaller_than_2 = SmallerThan(FirstNumber=deconstruct.XComponent, SecondNumber=max_width_x)  # -> SmallerThan, OrEqualTo
gate_and = GateAnd(A=larger_than.OrEqualTo, B=smaller_than.OrEqualTo, C=larger_than_2.OrEqualTo, D=smaller_than_2.OrEqualTo)
cull_pattern = CullPattern(List=mesh_vertices, CullPattern=gate_and)

deconstruct_2 = Deconstruct(Point=cull_pattern)  # -> XComponent, YComponent, ZComponent
equality = Equality(FirstNumber=deconstruct_2.ZComponent, SecondNumber="0")  # -> Equality, Inequality
cull_pattern_2 = CullPattern(List=cull_pattern, CullPattern=equality.Equality)
list_length = ListLength(List=cull_pattern_2)

deconstruct_3 = Deconstruct(Point=cull_pattern)  # -> XComponent, YComponent, ZComponent
equality_2 = Equality(FirstNumber=deconstruct_3.XComponent, SecondNumber="0")  # -> Equality, Inequality
cull_pattern_3 = CullPattern(List=cull_pattern, CullPattern=equality_2.Equality)
list_length_2 = ListLength(List=cull_pattern_3)

u_count = ClusterOutput(list_length)
v_count = ClusterOutput(list_length_2)

# ==== cluster Cluster_4
surface = ClusterInput()
surface_2 = Surface(surface)
srf = Surface(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)
crv = Curve([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])
number_slider = Slider(6, range=1..10)
number_slider_2 = Slider(6, range=1..10)
u_count = ClusterInput()
v_count = ClusterInput()
quad_panels = QuadPanels(Surface=surface_2, UDivisions=Slider(5, range=0..5), VDivisions=Slider(2, range=0..5))
quad_panels_2 = QuadPanels(Surface=surface_2, UDivisions=Slider(3, range=0..5), VDivisions=Slider(1, range=0..5))
divide_surface = DivideSurface(Surface=quad_panels, UCount=u_count, VCount=v_count)  # -> flatten(Points), Normals, Parameters
divide_surface_2 = DivideSurface(Surface=quad_panels_2, UCount=u_count, VCount=v_count)  # -> flatten(Points), Normals, Parameters
curve = Curve(quad_panels)
curve_2 = Curve(surface_2)
curve_3 = Curve(quad_panels_2)
pull_point = PullPoint(Point=divide_surface_2.Points, Geometry=curve_3, ClosestOnly=True)  # -> ClosestPoint, Distance
pull_point_2 = PullPoint(Point=divide_surface.Points, Geometry=curve, ClosestOnly=True)  # -> ClosestPoint, Distance
smaller_than = SmallerThan(FirstNumber=pull_point_2.Distance, SecondNumber="0.01")  # -> SmallerThan, OrEqualTo
smaller_than_2 = SmallerThan(FirstNumber=pull_point.Distance, SecondNumber="0.01")  # -> SmallerThan, OrEqualTo
cull_pattern = CullPattern(List=divide_surface.Points, CullPattern=invert(smaller_than.SmallerThan))
cull_pattern_2 = CullPattern(List=divide_surface_2.Points, CullPattern=invert(smaller_than_2.SmallerThan))
list_item = ListItem(List=cull_pattern, Index=0, Wrap=True)
is_planar = IsPlanar(Surface=surface_2, Interior=True)  # -> Planar, Plane
list_item_2 = ListItem(List=cull_pattern_2, Index=0, Wrap=True)
is_planar_2 = IsPlanar(Surface=surface_2, Interior=True)  # -> Planar, Plane
closest_point = ClosestPoint(Point=list_item, Cloud=pull_point_2.ClosestPoint)  # -> ClosestPoint, CPIndex, Distance
closest_point_2 = ClosestPoint(Point=list_item_2, Cloud=pull_point.ClosestPoint)  # -> ClosestPoint, CPIndex, Distance
division = Division(A=closest_point.Distance, B="2.5")
division_2 = Division(A=closest_point_2.Distance, B="2.5")
circle_cnr = CircleCNR(Center=cull_pattern, Normal=is_planar.Plane, Radius=division)
circle_cnr_2 = CircleCNR(Center=cull_pattern_2, Normal=is_planar_2.Plane, Radius=division_2)
area = Area(Geometry=circle_cnr)  # -> Area, Centroid
smaller_than_3 = SmallerThan(FirstNumber=area.Area, SecondNumber="0.01")  # -> SmallerThan, OrEqualTo
average = Average(Input=smaller_than_3.SmallerThan)
stream_filter = StreamFilter(Gate=average, Stream0=circle_cnr, Stream1=circle_cnr_2)
surface_split = SurfaceSplit(Surface=surface_2, Curves=stream_filter)
area_2 = Area(Geometry=surface_split)  # -> Area, Centroid
smaller_than_4 = SmallerThan(FirstNumber=area_2.Area, SecondNumber="3")  # -> SmallerThan, OrEqualTo
area_3 = ClusterOutput(area_2.Area)
cull_pattern_3 = CullPattern(List=surface_split, CullPattern=invert(smaller_than_4.SmallerThan))
list = ClusterOutput(cull_pattern_3)
